# Dynamo graph script.dyn "Duct Elbow Deflector" (Dynamo 2.6.1.8786)
# packages: Data-Shapes 2022.2.99, archi-lab.net 2023.213.1523

file_path = Filename("\\Svch01102\rsb$\PRO\000_Administration\022_Razmena\03_Office Template (Revit)\Extension\chemgineering_logo-1-700x350.png")
code_block = CodeBlock { "Gotovo"; }
code_block_2 = CodeBlock { "Ukupna povrsina za debljinu lima od 1mm [m2]:"; }
code_block_3 = CodeBlock { "Specfikacija usmerivaca pravougaonih kolena"; }
file_path_2 = Filename("\\Svch01102\rsb$\PRO\000_Administration\022_Razmena\03_Office Template (Revit)\Extension\chemgineering_logo-1-700x350.png")
code_block_4 = CodeBlock { "Pokreni"; }
code_block_5 = CodeBlock { "Selektuj elemente"; }
code_block_6 = CodeBlock { "Selektuj"; }
selectmodelelements_data = Custom[SelectModelElements Data](InputName=code_block_5, ButtonText=code_block_6)  # package Data-Shapes; Creates a Revit element selection input for UI.MultipleInputForm++ . Check out www.data-shapes.net for more infos!
boolean = BoolSelector(true)
code_block_7 = CodeBlock { "Ponisti"; }
multipleinputform = Custom[MultipleInputForm ++](Description_optional=code_block_3, Logo_optional=file_path_2, ButtonText_optional=code_block_4, Inputs=selectmodelelements_data, Toggle=boolean, CancelButtonText_optional=code_block_7)  # package Data-Shapes; Create a form with multiple inputs. see www.data-shapes.net for tutorials and infos!
code_block_8 = CodeBlock { "Family"; }
getParameterValueByName = Element.GetParameterValueByName(element=multipleinputform.User_Inputs, parameterName=code_block_8)
code_block_9 = CodeBlock { "Family Name"; }
getParameterValueByName_2 = Element.GetParameterValueByName(element=getParameterValueByName, parameterName=code_block_9)
code_block_10 = CodeBlock { "Rectangular Duct"; }
eq = getParameterValueByName_2 == code_block_10
filterByBoolMask = List.FilterByBoolMask(list=multipleinputform.User_Inputs, mask=eq)
code_block_11 = CodeBlock { "Family"; }
getParameterValueByName_3 = Element.GetParameterValueByName(element=filterByBoolMask.out, parameterName=code_block_11)
code_block_12 = CodeBlock { "Family Name"; }
getParameterValueByName_4 = Element.GetParameterValueByName(element=getParameterValueByName_3, parameterName=code_block_12)
code_block_13 = CodeBlock { "CGI-xxyy02-FTG-RO-Bend-Sym"; }
eq_2 = getParameterValueByName_4 == code_block_13
filterByBoolMask_2 = List.FilterByBoolMask(list=filterByBoolMask.out, mask=eq_2)
code_block_14 = CodeBlock { "a"; }
visina = Element.GetParameterValueByName(element=filterByBoolMask_2.in, parameterName=code_block_14)
code_block_15 = CodeBlock { "b"; }
visina_2 = Element.GetParameterValueByName(element=filterByBoolMask_2.in, parameterName=code_block_15)
max = Math.Max(value1=visina, value2=visina_2)
code_block_16 = CodeBlock { 1250; }
gt = max > code_block_16
filterByBoolMask_3 = List.FilterByBoolMask(list=filterByBoolMask_2.in, mask=gt)
code_block_17 = CodeBlock { "a"; }
visina_3 = Element.GetParameterValueByName(element=filterByBoolMask_3.in, parameterName=code_block_17)
code_block_18 = CodeBlock { "e1"; }
prirubnica = Element.GetParameterValueByName(element=filterByBoolMask_3.in, parameterName=code_block_18)
code_block_19 = CodeBlock { "f1"; }
prirubnica_2 = Element.GetParameterValueByName(element=filterByBoolMask_3.in, parameterName=code_block_19)
formula = Formula("e1*e1+f1*f1", e1=prirubnica, f1=prirubnica_2)
# note: d
sqrt = Math.Sqrt(number=formula)
code_block_20 = CodeBlock { "MittelpunktRadius"; }
r_bez_prirubnica = Element.GetParameterValueByName(element=filterByBoolMask_3.in, parameterName=code_block_20)
n1_r = Formula("d+MittelpunktRadius", d=sqrt, mittelpunktradius=r_bez_prirubnica)  # "1) r"
code_block_21 = CodeBlock { "alpha"; }
ugao = Element.GetParameterValueByName(element=filterByBoolMask_3.in, parameterName=code_block_21)
n1_l = Formula("r*3.14*alpha/180", r=n1_r, alpha=ugao)  # "1) l"
n1_p = Formula("h*l", h=visina_3, l=n1_l)  # "1) P"
sum = Math.Sum(values=n1_p)
code_block_22 = CodeBlock { "b"; }
sirina = Element.GetParameterValueByName(element=filterByBoolMask_3.in, parameterName=code_block_22)
n2_r = Formula("d+MittelpunktRadius-(b/2-b/6)", d=sqrt, mittelpunktradius=r_bez_prirubnica, b=sirina)  # "2) r"
n2_l = Formula("r*3.14*alpha/180", r=n2_r, alpha=ugao)  # "2) l"
n2_p = Formula("h*l", h=visina_3, l=n2_l)  # "2) P"
sum_2 = Math.Sum(values=n2_p)
join = List.Join(list0=sum, list1=sum_2)
sum_3 = Math.Sum(values=join)
convert_between_units = DynamoConvert(sum_3, MeasurementType="Area", FromConversion="SquareMillimeter", ToConversion="SquareMeter")
code_block_23 = CodeBlock { "a"; }
visina_4 = Element.GetParameterValueByName(element=filterByBoolMask_3.out, parameterName=code_block_23)
code_block_24 = CodeBlock { "b"; }
visina_5 = Element.GetParameterValueByName(element=filterByBoolMask_3.out, parameterName=code_block_24)
max_2 = Math.Max(value1=visina_4, value2=visina_5)
code_block_25 = CodeBlock { 1000; }
gt_2 = max_2 > code_block_25
filterByBoolMask_4 = List.FilterByBoolMask(list=filterByBoolMask_3.out, mask=gt_2)
code_block_26 = CodeBlock { "a"; }
visina_6 = Element.GetParameterValueByName(element=filterByBoolMask_4.in, parameterName=code_block_26)
code_block_27 = CodeBlock { "e1"; }
prirubnica_3 = Element.GetParameterValueByName(element=filterByBoolMask_4.in, parameterName=code_block_27)
code_block_28 = CodeBlock { "f1"; }
prirubnica_4 = Element.GetParameterValueByName(element=filterByBoolMask_4.in, parameterName=code_block_28)
formula_2 = Formula("e1*e1+f1*f1", e1=prirubnica_3, f1=prirubnica_4)
sqrt_2 = Math.Sqrt(number=formula_2)
code_block_29 = CodeBlock { "MittelpunktRadius"; }
r_bez_prirubnica_2 = Element.GetParameterValueByName(element=filterByBoolMask_4.in, parameterName=code_block_29)
code_block_30 = CodeBlock { "b"; }
sirina_2 = Element.GetParameterValueByName(element=filterByBoolMask_4.in, parameterName=code_block_30)
r = Formula("d+MittelpunktRadius-(b/2-b/3)", d=sqrt_2, mittelpunktradius=r_bez_prirubnica_2, b=sirina_2)
code_block_31 = CodeBlock { "alpha"; }
ugao_2 = Element.GetParameterValueByName(element=filterByBoolMask_4.in, parameterName=code_block_31)
n2_l_2 = Formula("r*3.14*alpha/180", r=r, alpha=ugao_2)  # "2) l"
n2_p_2 = Formula("h*l", h=visina_6, l=n2_l_2)  # "2) P"
sum_4 = Math.Sum(values=n2_p_2)
convert_between_units_2 = DynamoConvert(sum_4, MeasurementType="Area", FromConversion="SquareMillimeter", ToConversion="SquareMeter")
code_block_32 = CodeBlock { "Ukupna masa za debljinu lima od 1mm [kg]:"; }
masa_kg = Formula("s*8", s=convert_between_units)
masa_kg_2 = Formula("s*8", s=convert_between_units_2)

# group: 1mm
list_create = List.Create(item0=convert_between_units, item1=convert_between_units_2)
clear_list = Custom[Clear List](input=list_create)  # package archi-lab.net; This node will remove all Null and Empty Lists from any list.
sum_5 = Math.Sum(values=clear_list)
clear_list_2 = Custom[Clear List](input=sum_5)
list_create_2 = List.Create(item0=masa_kg, item1=masa_kg_2)
clear_list_3 = Custom[Clear List](input=list_create_2)
sum_6 = Math.Sum(values=clear_list_3)
clear_list_4 = Custom[Clear List](input=sum_6)

number_to_rounded_string = Custom[Number to Rounded String](Number=clear_list_2)  # package Data-Shapes; Returns rounded number to specified number of decimals as string
textnote_data = Custom[TextNote Data](Title=code_block_2, TextNote=number_to_rounded_string)  # package Data-Shapes; Create Data for TextNote input in UI.MultipleInputForm ++ . Check out www.data-shapes.net for more informations
number_to_rounded_string_2 = Custom[Number to Rounded String](Number=clear_list_4)
textnote_data_2 = Custom[TextNote Data](Title=code_block_32, TextNote=number_to_rounded_string_2)
code_block_33 = CodeBlock { "Ukupna povrsina za debljinu lima od 0.8mm [m2]:"; }
code_block_34 = CodeBlock { "a"; }
visina_7 = Element.GetParameterValueByName(element=filterByBoolMask_4.out, parameterName=code_block_34)
code_block_35 = CodeBlock { "b"; }
visina_8 = Element.GetParameterValueByName(element=filterByBoolMask_4.out, parameterName=code_block_35)
max_3 = Math.Max(value1=visina_7, value2=visina_8)
code_block_36 = CodeBlock { 500; }
gt_3 = max_3 > code_block_36
filterByBoolMask_5 = List.FilterByBoolMask(list=filterByBoolMask_4.out, mask=gt_3)
code_block_37 = CodeBlock { "a"; }
visina_9 = Element.GetParameterValueByName(element=filterByBoolMask_5.in, parameterName=code_block_37)
code_block_38 = CodeBlock { "e1"; }
prirubnica_5 = Element.GetParameterValueByName(element=filterByBoolMask_5.in, parameterName=code_block_38)
code_block_39 = CodeBlock { "f1"; }
prirubnica_6 = Element.GetParameterValueByName(element=filterByBoolMask_5.in, parameterName=code_block_39)
formula_3 = Formula("e1*e1+f1*f1", e1=prirubnica_5, f1=prirubnica_6)
sqrt_3 = Math.Sqrt(number=formula_3)
code_block_40 = CodeBlock { "MittelpunktRadius"; }
r_bez_prirubnica_3 = Element.GetParameterValueByName(element=filterByBoolMask_5.in, parameterName=code_block_40)
code_block_41 = CodeBlock { "b"; }
sirina_3 = Element.GetParameterValueByName(element=filterByBoolMask_5.in, parameterName=code_block_41)
r_2 = Formula("d+MittelpunktRadius-(b/2-b/3)", d=sqrt_3, mittelpunktradius=r_bez_prirubnica_3, b=sirina_3)
code_block_42 = CodeBlock { "alpha"; }
ugao_3 = Element.GetParameterValueByName(element=filterByBoolMask_5.in, parameterName=code_block_42)
n2_l_3 = Formula("r*3.14*alpha/180", r=r_2, alpha=ugao_3)  # "2) l"
n2_p_3 = Formula("h*l", h=visina_9, l=n2_l_3)  # "2) P"
sum_7 = Math.Sum(values=n2_p_3)

# group: 0.8 mm
convert_between_units_3 = DynamoConvert(sum_7, MeasurementType="Area", FromConversion="SquareMillimeter", ToConversion="SquareMeter")
masa_kg_3 = Formula("s*6.4", s=convert_between_units_3)

number_to_rounded_string_3 = Custom[Number to Rounded String](Number=convert_between_units_3)
textnote_data_3 = Custom[TextNote Data](Title=code_block_33, TextNote=number_to_rounded_string_3)
code_block_43 = CodeBlock { "Ukupna masa za debljinu lima od 0.8mm [kg]:"; }
number_to_rounded_string_4 = Custom[Number to Rounded String](Number=masa_kg_3)
textnote_data_4 = Custom[TextNote Data](Title=code_block_43, TextNote=number_to_rounded_string_4)
code_block_44 = CodeBlock { "Ukupna povrsina za debljinu lima od 0.6mm [m2]:"; }
code_block_45 = CodeBlock { "a"; }
visina_10 = Element.GetParameterValueByName(element=filterByBoolMask_5.out, parameterName=code_block_45)
code_block_46 = CodeBlock { "b"; }
visina_11 = Element.GetParameterValueByName(element=filterByBoolMask_5.out, parameterName=code_block_46)
max_4 = Math.Max(value1=visina_10, value2=visina_11)
code_block_47 = CodeBlock { 399; }
gt_4 = max_4 > code_block_47
filterByBoolMask_6 = List.FilterByBoolMask(list=filterByBoolMask_5.out, mask=gt_4)
code_block_48 = CodeBlock { "a"; }
visina_12 = Element.GetParameterValueByName(element=filterByBoolMask_6.in, parameterName=code_block_48)
code_block_49 = CodeBlock { "e1"; }
prirubnica_7 = Element.GetParameterValueByName(element=filterByBoolMask_6.in, parameterName=code_block_49)
code_block_50 = CodeBlock { "f1"; }
prirubnica_8 = Element.GetParameterValueByName(element=filterByBoolMask_6.in, parameterName=code_block_50)
formula_4 = Formula("e1*e1+f1*f1", e1=prirubnica_7, f1=prirubnica_8)
sqrt_4 = Math.Sqrt(number=formula_4)
code_block_51 = CodeBlock { "MittelpunktRadius"; }
r_bez_prirubnica_4 = Element.GetParameterValueByName(element=filterByBoolMask_6.in, parameterName=code_block_51)
code_block_52 = CodeBlock { "b"; }
sirina_4 = Element.GetParameterValueByName(element=filterByBoolMask_6.in, parameterName=code_block_52)
r_3 = Formula("d+MittelpunktRadius-(b/2-b/3)", d=sqrt_4, mittelpunktradius=r_bez_prirubnica_4, b=sirina_4)
code_block_53 = CodeBlock { "alpha"; }
ugao_4 = Element.GetParameterValueByName(element=filterByBoolMask_6.in, parameterName=code_block_53)
n2_l_4 = Formula("r*3.14*alpha/180", r=r_3, alpha=ugao_4)  # "2) l"
n2_p_4 = Formula("h*l", h=visina_12, l=n2_l_4)  # "2) P"
sum_8 = Math.Sum(values=n2_p_4)

# group: 0.6 mm
convert_between_units_4 = DynamoConvert(sum_8, MeasurementType="Area", FromConversion="SquareMillimeter", ToConversion="SquareMeter")
masa_kg_4 = Formula("s*4.8", s=convert_between_units_4)

number_to_rounded_string_5 = Custom[Number to Rounded String](Number=convert_between_units_4)
textnote_data_5 = Custom[TextNote Data](Title=code_block_44, TextNote=number_to_rounded_string_5)
code_block_54 = CodeBlock { "Ukupna masa za debljinu lima od 0.6mm [kg]:"; }
number_to_rounded_string_6 = Custom[Number to Rounded String](Number=masa_kg_4)
textnote_data_6 = Custom[TextNote Data](Title=code_block_54, TextNote=number_to_rounded_string_6)
join_2 = List.Join(list0=textnote_data, list1=textnote_data_2, list2=textnote_data_3, list3=textnote_data_4, list4=textnote_data_5, list5=textnote_data_6)
boolean_2 = BoolSelector(true)
number = DoubleInput(250)
multipleinputform_2 = Custom[MultipleInputForm ++](Logo_optional=file_path, ButtonText_optional=code_block, Inputs=join_2, Toggle=boolean_2, LabelWidth_optional=number)
