# Dynamo graph script.dyn "Duct Length" (Dynamo 2.6.1.8786)
# packages: Data-Shapes 2022.2.99, archi-lab.net 2023.213.1523

file_path = Filename("\\Svch01102\rsb$\PRO\000_Administration\022_Razmena\03_Office Template (Revit)\Extension\chemgineering_logo-1-700x350.png")
code_block = CodeBlock { "Gotovo"; }
code_block_2 = CodeBlock { "Ukupna duzina kanala iznosi [m]:"; }
code_block_3 = CodeBlock { "Izracunavanje duzine kanalskog sistema"; }
file_path_2 = Filename("\\Svch01102\rsb$\PRO\000_Administration\022_Razmena\03_Office Template (Revit)\Extension\chemgineering_logo-1-700x350.png")
code_block_4 = CodeBlock { "Pokreni"; }
code_block_5 = CodeBlock { "Selektuj elemente"; }
code_block_6 = CodeBlock { "Selektuj"; }
selectmodelelements_data = Custom[SelectModelElements Data](InputName=code_block_5, ButtonText=code_block_6)  # package Data-Shapes; Creates a Revit element selection input for UI.MultipleInputForm++ . Check out www.data-shapes.net for more infos!
boolean = BoolSelector(true)
code_block_7 = CodeBlock { "Ponisti"; }
multipleinputform = Custom[MultipleInputForm ++](Description_optional=code_block_3, Logo_optional=file_path_2, ButtonText_optional=code_block_4, Inputs=selectmodelelements_data, Toggle=boolean, CancelButtonText_optional=code_block_7)  # package Data-Shapes; Create a form with multiple inputs. see www.data-shapes.net for tutorials and infos!
code_block_8 = CodeBlock { "Family"; }
getParameterValueByName = Element.GetParameterValueByName(element=multipleinputform.User_Inputs, parameterName=code_block_8)
code_block_9 = CodeBlock { "Family Name"; }
getParameterValueByName_2 = Element.GetParameterValueByName(element=getParameterValueByName, parameterName=code_block_9)
code_block_10 = CodeBlock { "Rectangular Duct"; }
eq = getParameterValueByName_2 == code_block_10
filterByBoolMask = List.FilterByBoolMask(list=multipleinputform.User_Inputs, mask=eq)

# group: Kanali
code_block_11 = CodeBlock { "Length"; }
getParameterValueByName_3 = Element.GetParameterValueByName(element=filterByBoolMask.in, parameterName=code_block_11)
sum = Math.Sum(values=getParameterValueByName_3)

# group: Fitinzi
code_block_12 = CodeBlock { "Family"; }
getParameterValueByName_4 = Element.GetParameterValueByName(element=filterByBoolMask.out, parameterName=code_block_12)
code_block_13 = CodeBlock { "Family Name"; }
getParameterValueByName_5 = Element.GetParameterValueByName(element=getParameterValueByName_4, parameterName=code_block_13)

# group: Koleno
code_block_14 = CodeBlock { "RE Bogen BS - Flansch"; }
eq_2 = getParameterValueByName_5 == code_block_14
filterByBoolMask_2 = List.FilterByBoolMask(list=filterByBoolMask.out, mask=eq_2)
code_block_15 = CodeBlock { "f1"; }
getParameterValueByName_6 = Element.GetParameterValueByName(element=filterByBoolMask_2.in, parameterName=code_block_15)
code_block_16 = CodeBlock { "e1"; }
getParameterValueByName_7 = Element.GetParameterValueByName(element=filterByBoolMask_2.in, parameterName=code_block_16)
code_block_17 = CodeBlock { "Bogenradius"; }
getParameterValueByName_8 = Element.GetParameterValueByName(element=filterByBoolMask_2.in, parameterName=code_block_17)
formula = Formula("f1+e1+Bogenradius*3.14/2", f1=getParameterValueByName_6, e1=getParameterValueByName_7, bogenradius=getParameterValueByName_8)
sum_2 = Math.Sum(values=formula)

# group: Koleno
code_block_18 = CodeBlock { "RE Bogen BS - Flansch1"; }
eq_3 = getParameterValueByName_5 == code_block_18
filterByBoolMask_3 = List.FilterByBoolMask(list=filterByBoolMask.out, mask=eq_3)
code_block_19 = CodeBlock { "f1"; }
getParameterValueByName_9 = Element.GetParameterValueByName(element=filterByBoolMask_3.in, parameterName=code_block_19)
code_block_20 = CodeBlock { "e1"; }
getParameterValueByName_10 = Element.GetParameterValueByName(element=filterByBoolMask_3.in, parameterName=code_block_20)
code_block_21 = CodeBlock { "Bogenradius"; }
getParameterValueByName_11 = Element.GetParameterValueByName(element=filterByBoolMask_3.in, parameterName=code_block_21)
formula_2 = Formula("f1+e1+Bogenradius*3.14/2", f1=getParameterValueByName_9, e1=getParameterValueByName_10, bogenradius=getParameterValueByName_11)
sum_3 = Math.Sum(values=formula_2)

# group: T-Komad
code_block_22 = CodeBlock { "RE T-Stück gerade TG - Flansch1"; }
eq_4 = getParameterValueByName_5 == code_block_22
filterByBoolMask_4 = List.FilterByBoolMask(list=filterByBoolMask.out, mask=eq_4)
code_block_23 = CodeBlock { "l2"; }
getParameterValueByName_12 = Element.GetParameterValueByName(element=filterByBoolMask_4.in, parameterName=code_block_23)
code_block_24 = CodeBlock { "e1"; }
getParameterValueByName_13 = Element.GetParameterValueByName(element=filterByBoolMask_4.in, parameterName=code_block_24)
formula_3 = Formula("l2+e1", l2=getParameterValueByName_12, e1=getParameterValueByName_13)
sum_4 = Math.Sum(values=formula_3)

# group: Redukcija
code_block_25 = CodeBlock { "RE Übergang US - Flansch"; }
eq_5 = getParameterValueByName_5 == code_block_25
filterByBoolMask_5 = List.FilterByBoolMask(list=filterByBoolMask.out, mask=eq_5)
code_block_26 = CodeBlock { "Länge 4"; }
getParameterValueByName_14 = Element.GetParameterValueByName(element=filterByBoolMask_5.in, parameterName=code_block_26)
sum_5 = Math.Sum(values=getParameterValueByName_14)

# group: Redukcija
code_block_27 = CodeBlock { "RE Übergang US - Flansch1"; }
eq_6 = getParameterValueByName_5 == code_block_27
filterByBoolMask_6 = List.FilterByBoolMask(list=filterByBoolMask.out, mask=eq_6)
code_block_28 = CodeBlock { "Länge 4"; }
getParameterValueByName_15 = Element.GetParameterValueByName(element=filterByBoolMask_6.in, parameterName=code_block_28)
sum_6 = Math.Sum(values=getParameterValueByName_15)

# group: Cep
code_block_29 = CodeBlock { "RE Boden BO1"; }
eq_7 = getParameterValueByName_5 == code_block_29
filterByBoolMask_7 = List.FilterByBoolMask(list=filterByBoolMask.out, mask=eq_7)
code_block_30 = CodeBlock { "x1"; }

getParameterValueByName_16 = Element.GetParameterValueByName(element=filterByBoolMask_7.in, parameterName=code_block_30)

# group (continued): Cep
sum_7 = Math.Sum(values=getParameterValueByName_16)

# group: Redukovano koleno
code_block_31 = CodeBlock { "Bogen rechteck asym BA"; }
eq_8 = getParameterValueByName_5 == code_block_31
filterByBoolMask_8 = List.FilterByBoolMask(list=filterByBoolMask.out, mask=eq_8)
code_block_32 = CodeBlock { "Länge 19"; }
getParameterValueByName_17 = Element.GetParameterValueByName(element=filterByBoolMask_8.in, parameterName=code_block_32)
code_block_33 = CodeBlock { "Länge 15"; }
getParameterValueByName_18 = Element.GetParameterValueByName(element=filterByBoolMask_8.in, parameterName=code_block_33)
code_block_34 = CodeBlock { "b"; }
getParameterValueByName_19 = Element.GetParameterValueByName(element=filterByBoolMask_8.in, parameterName=code_block_34)
formula_4 = Formula("l19+l15-b", l19=getParameterValueByName_17, l15=getParameterValueByName_18, b=getParameterValueByName_19)

# group: Koleno
code_block_35 = CodeBlock { "CGI-xxyy02-FTG-RO-Bend-Sym"; }
eq_9 = getParameterValueByName_5 == code_block_35
filterByBoolMask_9 = List.FilterByBoolMask(list=filterByBoolMask.out, mask=eq_9)
code_block_36 = CodeBlock { "f1"; }
getParameterValueByName_20 = Element.GetParameterValueByName(element=filterByBoolMask_9.in, parameterName=code_block_36)
code_block_37 = CodeBlock { "e1"; }
getParameterValueByName_21 = Element.GetParameterValueByName(element=filterByBoolMask_9.in, parameterName=code_block_37)
code_block_38 = CodeBlock { "MittelpunktRadius"; }
getParameterValueByName_22 = Element.GetParameterValueByName(element=filterByBoolMask_9.in, parameterName=code_block_38)
formula_5 = Formula("f1+e1+MittelpunktRadius*3.14/2", f1=getParameterValueByName_20, e1=getParameterValueByName_21, mittelpunktradius=getParameterValueByName_22)
sum_8 = Math.Sum(values=formula_5)

# group: T-Komad
code_block_39 = CodeBlock { "CGI-xxyy02-FTG-RO-Branch-T-Piece"; }
eq_10 = getParameterValueByName_5 == code_block_39
filterByBoolMask_10 = List.FilterByBoolMask(list=filterByBoolMask.out, mask=eq_10)
code_block_40 = CodeBlock { "l"; }
getParameterValueByName_23 = Element.GetParameterValueByName(element=filterByBoolMask_10.in, parameterName=code_block_40)
code_block_41 = CodeBlock { "m1"; }
getParameterValueByName_24 = Element.GetParameterValueByName(element=filterByBoolMask_10.in, parameterName=code_block_41)
formula_6 = Formula("l+m1", l=getParameterValueByName_23, m1=getParameterValueByName_24)
sum_9 = Math.Sum(values=formula_6)

# group: Cep
code_block_42 = CodeBlock { "CGI-xxyy02-FTG-RO-Cap-EndCap"; }
eq_11 = getParameterValueByName_5 == code_block_42
filterByBoolMask_11 = List.FilterByBoolMask(list=filterByBoolMask.out, mask=eq_11)
code_block_43 = CodeBlock { 0; }
getItemAtIndex = List.GetItemAtIndex(list=filterByBoolMask_11.in, index=code_block_43)
count = List.Count(list=getItemAtIndex)
formula_7 = Formula("n*15", n=count)

# group: Redukcija
code_block_44 = CodeBlock { "CGI-xxyy02-FTG-RO-Reduction"; }
eq_12 = getParameterValueByName_5 == code_block_44
filterByBoolMask_12 = List.FilterByBoolMask(list=filterByBoolMask.out, mask=eq_12)
code_block_45 = CodeBlock { "Länge 4"; }
getParameterValueByName_25 = Element.GetParameterValueByName(element=filterByBoolMask_12.in, parameterName=code_block_45)
sum_10 = Math.Sum(values=getParameterValueByName_25)

# group: Redukcija pravougaoni-kruzni
code_block_46 = CodeBlock { "CGI-xxyy02-FTG-RO-Transition-Re2Ro-Sym"; }
eq_13 = getParameterValueByName_5 == code_block_46
filterByBoolMask_13 = List.FilterByBoolMask(list=filterByBoolMask.out, mask=eq_13)
code_block_47 = CodeBlock { "RLT_DIN_l"; }
getParameterValueByName_26 = Element.GetParameterValueByName(element=filterByBoolMask_13.in, parameterName=code_block_47)
sum_11 = Math.Sum(values=getParameterValueByName_26)

# group: Redukcija pravougaoni-kruzni
code_block_48 = CodeBlock { "CGI-xxyy02-FTG-RO-Transition-Re2Ro-Asym"; }
eq_14 = getParameterValueByName_5 == code_block_48
filterByBoolMask_14 = List.FilterByBoolMask(list=filterByBoolMask.out, mask=eq_14)
code_block_49 = CodeBlock { "RLT_DIN_l"; }
getParameterValueByName_27 = Element.GetParameterValueByName(element=filterByBoolMask_14.in, parameterName=code_block_49)
sum_12 = Math.Sum(values=getParameterValueByName_27)

# group: Cipela
code_block_50 = CodeBlock { "CGI-xxyy02-FTG-RO-Branch-TapShoe45"; }
eq_15 = getParameterValueByName_5 == code_block_50
filterByBoolMask_15 = List.FilterByBoolMask(list=filterByBoolMask.out, mask=eq_15)
code_block_51 = CodeBlock { "Länge"; }
getParameterValueByName_28 = Element.GetParameterValueByName(element=filterByBoolMask_15.in, parameterName=code_block_51)
sum_13 = Math.Sum(values=getParameterValueByName_28)

code_block_52 = CodeBlock { "Round Duct"; }
eq_16 = getParameterValueByName_2 == code_block_52
filterByBoolMask_16 = List.FilterByBoolMask(list=multipleinputform.User_Inputs, mask=eq_16)

# group: Kanali
code_block_53 = CodeBlock { "Length"; }
getParameterValueByName_29 = Element.GetParameterValueByName(element=filterByBoolMask_16.in, parameterName=code_block_53)
sum_14 = Math.Sum(values=getParameterValueByName_29)

# group: Fitinzi
code_block_54 = CodeBlock { "Family"; }
getParameterValueByName_30 = Element.GetParameterValueByName(element=filterByBoolMask_16.out, parameterName=code_block_54)
code_block_55 = CodeBlock { "Family Name"; }
getParameterValueByName_31 = Element.GetParameterValueByName(element=getParameterValueByName_30, parameterName=code_block_55)

# group: Koleno
code_block_56 = CodeBlock { "RU Bogen - Gleitgelenk1"; }
eq_17 = getParameterValueByName_31 == code_block_56
filterByBoolMask_17 = List.FilterByBoolMask(list=filterByBoolMask_16.out, mask=eq_17)
code_block_57 = CodeBlock { "rm"; }
getParameterValueByName_32 = Element.GetParameterValueByName(element=filterByBoolMask_17.in, parameterName=code_block_57)
formula_8 = Formula("rm*3.14/2", rm=getParameterValueByName_32)
sum_15 = Math.Sum(values=formula_8)

# group: Redukcija
code_block_58 = CodeBlock { "M_Round Transition - Angle"; }
eq_18 = getParameterValueByName_31 == code_block_58
filterByBoolMask_18 = List.FilterByBoolMask(list=filterByBoolMask_16.out, mask=eq_18)
code_block_59 = CodeBlock { "ComputedLength"; }
getParameterValueByName_33 = Element.GetParameterValueByName(element=filterByBoolMask_18.in, parameterName=code_block_59)
sum_16 = Math.Sum(values=getParameterValueByName_33)

# group: T-Komad
code_block_60 = CodeBlock { "Round Tee - Slip Joint"; }
eq_19 = getParameterValueByName_31 == code_block_60
filterByBoolMask_19 = List.FilterByBoolMask(list=filterByBoolMask_16.out, mask=eq_19)
code_block_61 = CodeBlock { "Length 1"; }
getParameterValueByName_34 = Element.GetParameterValueByName(element=filterByBoolMask_19.in, parameterName=code_block_61)
code_block_62 = CodeBlock { "Length 4"; }
getParameterValueByName_35 = Element.GetParameterValueByName(element=filterByBoolMask_19.in, parameterName=code_block_62)
formula_9 = Formula("l1+l4", l1=getParameterValueByName_34, l4=getParameterValueByName_35)
sum_17 = Math.Sum(values=formula_9)

# group: Koleno
code_block_63 = CodeBlock { "CGI-xxyy01-FTG-RO-Bend-Pressed"; }
eq_20 = getParameterValueByName_31 == code_block_63
filterByBoolMask_20 = List.FilterByBoolMask(list=filterByBoolMask_16.out, mask=eq_20)
code_block_64 = CodeBlock { "Neck Length"; }
getParameterValueByName_36 = Element.GetParameterValueByName(element=filterByBoolMask_20.in, parameterName=code_block_64)
code_block_65 = CodeBlock { "rm"; }
getParameterValueByName_37 = Element.GetParameterValueByName(element=filterByBoolMask_20.in, parameterName=code_block_65)
formula_10 = Formula("2*n+rm*3.14/2", n=getParameterValueByName_36, rm=getParameterValueByName_37)
sum_18 = Math.Sum(values=formula_10)

# group: T-Komad
code_block_66 = CodeBlock { "CGI-xxyy01-FTG-RO-Branch-T-Piece"; }
eq_21 = getParameterValueByName_31 == code_block_66
filterByBoolMask_21 = List.FilterByBoolMask(list=filterByBoolMask_16.out, mask=eq_21)
code_block_67 = CodeBlock { "TAB_L1"; }
getParameterValueByName_38 = Element.GetParameterValueByName(element=filterByBoolMask_21.in, parameterName=code_block_67)
formula_11 = Formula("3*t1", t1=getParameterValueByName_38)
sum_19 = Math.Sum(values=formula_11)

# group: Redukcija
code_block_68 = CodeBlock { "CGI-xxyy01-FTG-RO-Reduction"; }
eq_22 = getParameterValueByName_31 == code_block_68
filterByBoolMask_22 = List.FilterByBoolMask(list=filterByBoolMask_16.out, mask=eq_22)
code_block_69 = CodeBlock { "l1"; }
getParameterValueByName_39 = Element.GetParameterValueByName(element=filterByBoolMask_22.in, parameterName=code_block_69)
sum_20 = Math.Sum(values=getParameterValueByName_39)

list_create = List.Create(item0=sum, item1=sum_2, item2=sum_3, item3=sum_4, item4=sum_5, item5=sum_6, item6=sum_7, item7=formula_4, item8=sum_8, item9=sum_9, item10=formula_7, item11=sum_10, item12=sum_11, item13=sum_12, item14=sum_13, item15=sum_14, item16=sum_15, item17=sum_16, item18=sum_17, item19=sum_18, item20=sum_19, item21=sum_20)
sum_21 = Math.Sum(values=list_create)
clear_list = Custom[Clear List](input=sum_21)  # package archi-lab.net; This node will remove all Null and Empty Lists from any list.
sum_22 = Math.Sum(values=clear_list)
convert_between_units = DynamoConvert(sum_22, MeasurementType="Length", FromConversion="Millimeters", ToConversion="Meters")
number_to_rounded_string = Custom[Number to Rounded String](Number=convert_between_units)  # package Data-Shapes; Returns rounded number to specified number of decimals as string
textnote_data = Custom[TextNote Data](Title=code_block_2, TextNote=number_to_rounded_string)  # package Data-Shapes; Create Data for TextNote input in UI.MultipleInputForm ++ . Check out www.data-shapes.net for more informations
boolean_2 = BoolSelector(true)
number = DoubleInput(250)
multipleinputform_2 = Custom[MultipleInputForm ++](Logo_optional=file_path, ButtonText_optional=code_block, Inputs=textnote_data, Toggle=boolean_2, LabelWidth_optional=number)
