# Dynamo graph script.dyn (Dynamo 2.6.2.15705)
# packages: Data-Shapes 2022.2.99, Genius Loci 2021.11.10, archi-lab.net 2023.213.1523

code_block = CodeBlock { "Specifikacija cevi i fitinga"; "Specifikacija"; }
code_block_2 = CodeBlock { "Specifikacija sistema cevi"; }
file_path = Filename("\\Svch01102\rsb$\PRO\000_Administration\022_Razmena\03_Office Template (Revit)\Extension\chemgineering_logo-1-700x350.png")
code_block_3 = CodeBlock { "Pokreni"; }
code_block_4 = CodeBlock { "Selektuj sistem cevi"; }
code_block_5 = CodeBlock { "Selektuj"; }
selectmodelelements_data = Custom[SelectModelElements Data](InputName=code_block_4, ButtonText=code_block_5)  # package Data-Shapes; Creates a Revit element selection input for UI.MultipleInputForm++ . Check out www.data-shapes.net for more infos!
boolean = BoolSelector(true)
code_block_6 = CodeBlock { "Ponisti"; }
multipleinputform = Custom[MultipleInputForm ++](Description_optional=code_block_2, Logo_optional=file_path, ButtonText_optional=code_block_3, Inputs=selectmodelelements_data, Toggle=boolean, CancelButtonText_optional=code_block_6)  # package Data-Shapes; Create a form with multiple inputs. see www.data-shapes.net for tutorials and infos!
code_block_7 = CodeBlock { "Family"; }
getParameterValueByName = Element.GetParameterValueByName(element=multipleinputform.User_Inputs, parameterName=code_block_7)
code_block_8 = CodeBlock { "Family Name"; }
getParameterValueByName_2 = Element.GetParameterValueByName(element=getParameterValueByName, parameterName=code_block_8)

# group: Cevi
code_block_9 = CodeBlock { 2; 0; }
code_block_10 = CodeBlock { "Pipe Types"; }
eq = getParameterValueByName_2 == code_block_10
filterByBoolMask = List.FilterByBoolMask(list=multipleinputform.User_Inputs, mask=eq)
code_block_11 = CodeBlock { 0; }
getItemAtIndex = List.GetItemAtIndex(list=filterByBoolMask.in, index=code_block_11)
code_block_12 = CodeBlock { "Size"; }
getParameterValueByName_3 = Element.GetParameterValueByName(element=getItemAtIndex, parameterName=code_block_12)
groupByKey = List.GroupByKey(list=getItemAtIndex, keys=getParameterValueByName_3)
code_block_13 = CodeBlock { "Length"; }
getParameterValueByName_4 = Element.GetParameterValueByName(element=groupByKey.groups, parameterName=code_block_13)
sum = Math.Sum(values=getParameterValueByName_4)
convert_between_units = DynamoConvert(sum, MeasurementType="Length", FromConversion="Millimeters", ToConversion="Meters")
code_block_14 = CodeBlock { 1; }
number_to_rounded_string = Custom[Number to Rounded String](Number=convert_between_units, Decimals=code_block_14)  # package Data-Shapes; Returns rounded number to specified number of decimals as string
list_create = List.Create(item0=groupByKey.unique_keys, item1=number_to_rounded_string)
transpose = List.Transpose(lists=list_create)
code_block_15 = CodeBlock { "Cev"; }
code_block_16 = CodeBlock { 0; }
insertAtIndex = Custom[InsertAtIndex](list=transpose, element=code_block_15, index=code_block_16)  # package Genius Loci; Inserts items into lists at specified indices.
code_block_17 = CodeBlock { "m"; }
code_block_18 = CodeBlock { 2; }
insertAtIndex_2 = Custom[InsertAtIndex](list=insertAtIndex, element=code_block_17, index=code_block_18)
exportExcel = Data.ExportExcel(filePath=code_block.out0, sheetName=code_block.out1, startRow=code_block_9.out0, startCol=code_block_9.out1, data=insertAtIndex_2)

code_block_19 = CodeBlock { 0; 0..3; }
code_block_20 = CodeBlock { "Element"; "Dimenzija"; "Jedinica"; "Kolicina"; }
join = List.Join(list0=code_block_20.out0, list1=code_block_20.out1, list2=code_block_20.out2, list3=code_block_20.out3)
exportExcel_2 = Data.ExportExcel(filePath=code_block.out0, sheetName=code_block.out1, startRow=code_block_19.out0, startCol=code_block_19.out1@L1, data=join@L1)

# group: Kolena
count = List.Count(list=groupByKey.unique_keys)
formula = Formula("c+3", c=count)
code_block_21 = CodeBlock { 0; }
code_block_22 = CodeBlock { "Bend"; }
contains = String.Contains(str=getParameterValueByName_2, searchFor=code_block_22)
filterByBoolMask_2 = List.FilterByBoolMask(list=multipleinputform.User_Inputs, mask=contains)
code_block_23 = CodeBlock { 0; }
getItemAtIndex_2 = List.GetItemAtIndex(list=filterByBoolMask_2.in, index=code_block_23)
code_block_24 = CodeBlock { "Size"; }
getParameterValueByName_5 = Element.GetParameterValueByName(element=getItemAtIndex_2, parameterName=code_block_24)
groupByKey_2 = List.GroupByKey(list=getItemAtIndex_2, keys=getParameterValueByName_5)
count_2 = List.Count()  # unwired: list
map = List.Map(list=groupByKey_2.groups, f_x=count_2)
list_create_2 = List.Create(item0=groupByKey_2.unique_keys, item1=map)
transpose_2 = List.Transpose(lists=list_create_2)
code_block_25 = CodeBlock { "Koleno"; }
code_block_26 = CodeBlock { 0; }
insertAtIndex_3 = Custom[InsertAtIndex](list=transpose_2, element=code_block_25, index=code_block_26)
code_block_27 = CodeBlock { "kom"; }
code_block_28 = CodeBlock { 2; }
insertAtIndex_4 = Custom[InsertAtIndex](list=insertAtIndex_3, element=code_block_27, index=code_block_28)
count_3 = List.Count()  # unwired: list
map_2 = List.Map(list=insertAtIndex_4, f_x=count_3)
code_block_29 = CodeBlock { 1; }
eq_2 = map_2 == code_block_29
allTrue = List.AllTrue(list=eq_2)
delete = archilab.Revit.Elements.Elements.Delete(element=insertAtIndex_4)
if_ = If(test=allTrue, true=delete, false=insertAtIndex_4)
exportExcel_3 = Data.ExportExcel(filePath=code_block.out0, sheetName=code_block.out1, startRow=formula, startCol=code_block_21, data=if_)

# group: T-Komad
count_4 = List.Count(list=groupByKey.unique_keys)
count_5 = List.Count(list=groupByKey_2.unique_keys)
join_2 = List.Join(list0=count_4, list1=count_5)
sum_2 = Math.Sum(values=join_2)
formula_2 = Formula("c+4", c=sum_2)
code_block_30 = CodeBlock { 0; }
code_block_31 = CodeBlock { "Branch"; }
contains_2 = String.Contains(str=getParameterValueByName_2, searchFor=code_block_31)
filterByBoolMask_3 = List.FilterByBoolMask(list=multipleinputform.User_Inputs, mask=contains_2)
code_block_32 = CodeBlock { 0; }
getItemAtIndex_3 = List.GetItemAtIndex(list=filterByBoolMask_3.in, index=code_block_32)
code_block_33 = CodeBlock { "Size"; }
getParameterValueByName_6 = Element.GetParameterValueByName(element=getItemAtIndex_3, parameterName=code_block_33)
groupByKey_3 = List.GroupByKey(list=getItemAtIndex_3, keys=getParameterValueByName_6)
count_6 = List.Count()  # unwired: list
map_3 = List.Map(list=groupByKey_3.groups, f_x=count_6)
list_create_3 = List.Create(item0=groupByKey_3.unique_keys, item1=map_3)
transpose_3 = List.Transpose(lists=list_create_3)
code_block_34 = CodeBlock { "T-Komad"; }
code_block_35 = CodeBlock { 0; }
insertAtIndex_5 = Custom[InsertAtIndex](list=transpose_3, element=code_block_34, index=code_block_35)
code_block_36 = CodeBlock { "kom"; }
code_block_37 = CodeBlock { 2; }
insertAtIndex_6 = Custom[InsertAtIndex](list=insertAtIndex_5, element=code_block_36, index=code_block_37)
count_7 = List.Count()  # unwired: list
map_4 = List.Map(list=insertAtIndex_6, f_x=count_7)
code_block_38 = CodeBlock { 1; }
eq_3 = map_4 == code_block_38
allTrue_2 = List.AllTrue(list=eq_3)
delete_2 = archilab.Revit.Elements.Elements.Delete(element=insertAtIndex_6)
if_2 = If(test=allTrue_2, true=delete_2, false=insertAtIndex_6)
exportExcel_4 = Data.ExportExcel(filePath=code_block.out0, sheetName=code_block.out1, startRow=formula_2, startCol=code_block_30, data=if_2)

# group: Redukcija
count_8 = List.Count(list=groupByKey.unique_keys)
count_9 = List.Count(list=groupByKey_2.unique_keys)
count_10 = List.Count(list=groupByKey_3.unique_keys)
join_3 = List.Join(list0=count_8, list1=count_9, list2=count_10)
sum_3 = Math.Sum(values=join_3)
formula_3 = Formula("c+5", c=sum_3)
code_block_39 = CodeBlock { 0; }
code_block_40 = CodeBlock { "Reduction"; }
contains_3 = String.Contains(str=getParameterValueByName_2, searchFor=code_block_40)
filterByBoolMask_4 = List.FilterByBoolMask(list=multipleinputform.User_Inputs, mask=contains_3)
code_block_41 = CodeBlock { 0; }
getItemAtIndex_4 = List.GetItemAtIndex(list=filterByBoolMask_4.in, index=code_block_41)
code_block_42 = CodeBlock { "Size"; }
getParameterValueByName_7 = Element.GetParameterValueByName(element=getItemAtIndex_4, parameterName=code_block_42)
groupByKey_4 = List.GroupByKey(list=getItemAtIndex_4, keys=getParameterValueByName_7)
count_11 = List.Count()  # unwired: list
map_5 = List.Map(list=groupByKey_4.groups, f_x=count_11)
list_create_4 = List.Create(item0=groupByKey_4.unique_keys, item1=map_5)
transpose_4 = List.Transpose(lists=list_create_4)
code_block_43 = CodeBlock { "Redukcija"; }
code_block_44 = CodeBlock { 0; }
insertAtIndex_7 = Custom[InsertAtIndex](list=transpose_4, element=code_block_43, index=code_block_44)
code_block_45 = CodeBlock { "kom"; }
code_block_46 = CodeBlock { 2; }
insertAtIndex_8 = Custom[InsertAtIndex](list=insertAtIndex_7, element=code_block_45, index=code_block_46)
count_12 = List.Count()  # unwired: list
map_6 = List.Map(list=insertAtIndex_8, f_x=count_12)
code_block_47 = CodeBlock { 1; }
eq_4 = map_6 == code_block_47
allTrue_3 = List.AllTrue(list=eq_4)
delete_3 = archilab.Revit.Elements.Elements.Delete(element=insertAtIndex_8)
if_3 = If(test=allTrue_3, true=delete_3, false=insertAtIndex_8)
exportExcel_5 = Data.ExportExcel(filePath=code_block.out0, sheetName=code_block.out1, startRow=formula_3, startCol=code_block_39, data=if_3)

# group: Cep
count_13 = List.Count(list=groupByKey.unique_keys)
count_14 = List.Count(list=groupByKey_2.unique_keys)
count_15 = List.Count(list=groupByKey_3.unique_keys)
count_16 = List.Count(list=groupByKey_4.unique_keys)
join_4 = List.Join(list0=count_13, list1=count_14, list2=count_15, list3=count_16)
sum_4 = Math.Sum(values=join_4)
formula_4 = Formula("c+6", c=sum_4)
code_block_48 = CodeBlock { 0; }
code_block_49 = CodeBlock { "Cap"; }
contains_4 = String.Contains(str=getParameterValueByName_2, searchFor=code_block_49)
filterByBoolMask_5 = List.FilterByBoolMask(list=multipleinputform.User_Inputs, mask=contains_4)
code_block_50 = CodeBlock { 0; }
getItemAtIndex_5 = List.GetItemAtIndex(list=filterByBoolMask_5.in, index=code_block_50)
code_block_51 = CodeBlock { "Size"; }
getParameterValueByName_8 = Element.GetParameterValueByName(element=getItemAtIndex_5, parameterName=code_block_51)
groupByKey_5 = List.GroupByKey(list=getItemAtIndex_5, keys=getParameterValueByName_8)
count_17 = List.Count()  # unwired: list
map_7 = List.Map(list=groupByKey_5.groups, f_x=count_17)
list_create_5 = List.Create(item0=groupByKey_5.unique_keys, item1=map_7)
transpose_5 = List.Transpose(lists=list_create_5)
code_block_52 = CodeBlock { "Cep"; }
code_block_53 = CodeBlock { 0; }
insertAtIndex_9 = Custom[InsertAtIndex](list=transpose_5, element=code_block_52, index=code_block_53)
code_block_54 = CodeBlock { "kom"; }
code_block_55 = CodeBlock { 2; }
insertAtIndex_10 = Custom[InsertAtIndex](list=insertAtIndex_9, element=code_block_54, index=code_block_55)
count_18 = List.Count()  # unwired: list
map_8 = List.Map(list=insertAtIndex_10, f_x=count_18)
code_block_56 = CodeBlock { 1; }
eq_5 = map_8 == code_block_56
allTrue_4 = List.AllTrue(list=eq_5)
delete_4 = archilab.Revit.Elements.Elements.Delete(element=insertAtIndex_10)
if_4 = If(test=allTrue_4, true=delete_4, false=insertAtIndex_10)
exportExcel_6 = Data.ExportExcel(filePath=code_block.out0, sheetName=code_block.out1, startRow=formula_4, startCol=code_block_48, data=if_4)
