# Dynamo graph script.dyn (Dynamo 2.6.1.8786)
# packages: Data-Shapes 2022.2.99, archi-lab.net 2023.213.1523

code_block = CodeBlock { "Specifikacija cevi"; }
file_path = Filename("\\Svch01102\rsb$\PRO\000_Administration\022_Razmena\03_Office Template (Revit)\Extension\chemgineering_logo-1-700x350.png")
code_block_2 = CodeBlock { "Gotovo"; }
code_block_3 = CodeBlock { "Ukupna masa [kg]:"; }
code_block_4 = CodeBlock { "Specifikacija cevi"; }
file_path_2 = Filename("\\Svch01102\rsb$\PRO\000_Administration\022_Razmena\03_Office Template (Revit)\Extension\chemgineering_logo-1-700x350.png")
code_block_5 = CodeBlock { "Pokreni"; }
code_block_6 = CodeBlock { "Izabrati tecnost"; }
code_block_7 = CodeBlock { "/"; }
code_block_8 = CodeBlock { "Voda"; }
code_block_9 = CodeBlock { "Etilen Glikol 30%"; }
list_create = List.Create(item0=code_block_7, item1=code_block_8, item2=code_block_9)
boolean = BoolSelector(false)
dropdown_data = Custom[DropDown Data](InputName=code_block_6, Keys=list_create, Values=list_create, Sorted_optional=boolean)  # package Data-Shapes; Create data for DropDown input in UI.MultiInputForm ++ . Check out www.data-shapes.net for more infos.
code_block_10 = CodeBlock { "Selektuj cevi"; }
code_block_11 = CodeBlock { "Select"; }
selectmodelelements_data = Custom[SelectModelElements Data](InputName=code_block_10, ButtonText=code_block_11)  # package Data-Shapes; Creates a Revit element selection input for UI.MultipleInputForm++ . Check out www.data-shapes.net for more infos!
list_create_2 = List.Create(item0=dropdown_data, item1=selectmodelelements_data)
boolean_2 = BoolSelector(true)
code_block_12 = CodeBlock { "Ponisti"; }
multipleinputform = Custom[MultipleInputForm ++](Description_optional=code_block_4, Logo_optional=file_path_2, ButtonText_optional=code_block_5, Inputs=list_create_2, Toggle=boolean_2, CancelButtonText_optional=code_block_12)  # package Data-Shapes; Create a form with multiple inputs. see www.data-shapes.net for tutorials and infos!
code_block_13 = CodeBlock { 1; }
getItemAtIndex = List.GetItemAtIndex(list=multipleinputform.User_Inputs, index=code_block_13)
code_block_14 = CodeBlock { "Family"; }
getParameterValueByName = Element.GetParameterValueByName(element=getItemAtIndex, parameterName=code_block_14)
code_block_15 = CodeBlock { "Family Name"; }
getParameterValueByName_2 = Element.GetParameterValueByName(element=getParameterValueByName, parameterName=code_block_15)

# group: Cevi
code_block_16 = CodeBlock { "Pipe Types"; }
eq = getParameterValueByName_2 == code_block_16
filterByBoolMask = List.FilterByBoolMask(list=getItemAtIndex, mask=eq)
code_block_17 = CodeBlock { "Diameter"; }
getParameterValueByName_3 = Element.GetParameterValueByName(element=filterByBoolMask.in, parameterName=code_block_17)
code_block_18 = CodeBlock { 15; }
eq_2 = getParameterValueByName_3 == code_block_18
filterByBoolMask_2 = List.FilterByBoolMask(list=filterByBoolMask.in, mask=eq_2)
code_block_19 = CodeBlock { "Length"; }
getParameterValueByName_4 = Element.GetParameterValueByName(element=filterByBoolMask_2.in, parameterName=code_block_19)
convert_between_units = DynamoConvert(getParameterValueByName_4, MeasurementType="Length", FromConversion="Millimeters", ToConversion="Meters")
sum = Math.Sum(values=convert_between_units)
formula = Formula("l*0.95", l=sum)
code_block_20 = CodeBlock { 20; }
eq_3 = getParameterValueByName_3 == code_block_20
filterByBoolMask_3 = List.FilterByBoolMask(list=filterByBoolMask.in, mask=eq_3)
code_block_21 = CodeBlock { "Length"; }
getParameterValueByName_5 = Element.GetParameterValueByName(element=filterByBoolMask_3.in, parameterName=code_block_21)
convert_between_units_2 = DynamoConvert(getParameterValueByName_5, MeasurementType="Length", FromConversion="Millimeters", ToConversion="Meters")
sum_2 = Math.Sum(values=convert_between_units_2)
formula_2 = Formula("l*1.40", l=sum_2)
code_block_22 = CodeBlock { 25; }
eq_4 = getParameterValueByName_3 == code_block_22
filterByBoolMask_4 = List.FilterByBoolMask(list=filterByBoolMask.in, mask=eq_4)
code_block_23 = CodeBlock { "Length"; }
getParameterValueByName_6 = Element.GetParameterValueByName(element=filterByBoolMask_4.in, parameterName=code_block_23)
convert_between_units_3 = DynamoConvert(getParameterValueByName_6, MeasurementType="Length", FromConversion="Millimeters", ToConversion="Meters")
sum_3 = Math.Sum(values=convert_between_units_3)
formula_3 = Formula("l*1.99", l=sum_3)
code_block_24 = CodeBlock { 32; }
eq_5 = getParameterValueByName_3 == code_block_24
filterByBoolMask_5 = List.FilterByBoolMask(list=filterByBoolMask.in, mask=eq_5)
code_block_25 = CodeBlock { "Length"; }
getParameterValueByName_7 = Element.GetParameterValueByName(element=filterByBoolMask_5.in, parameterName=code_block_25)
convert_between_units_4 = DynamoConvert(getParameterValueByName_7, MeasurementType="Length", FromConversion="Millimeters", ToConversion="Meters")
sum_4 = Math.Sum(values=convert_between_units_4)
formula_4 = Formula("l*2.55", l=sum_4)
code_block_26 = CodeBlock { 40; }
eq_6 = getParameterValueByName_3 == code_block_26
filterByBoolMask_6 = List.FilterByBoolMask(list=filterByBoolMask.in, mask=eq_6)
code_block_27 = CodeBlock { "Length"; }
getParameterValueByName_8 = Element.GetParameterValueByName(element=filterByBoolMask_6.in, parameterName=code_block_27)
convert_between_units_5 = DynamoConvert(getParameterValueByName_8, MeasurementType="Length", FromConversion="Millimeters", ToConversion="Meters")
sum_5 = Math.Sum(values=convert_between_units_5)
formula_5 = Formula("l*2.93", l=sum_5)
code_block_28 = CodeBlock { 50; }
eq_7 = getParameterValueByName_3 == code_block_28
filterByBoolMask_7 = List.FilterByBoolMask(list=filterByBoolMask.in, mask=eq_7)
code_block_29 = CodeBlock { "Length"; }
getParameterValueByName_9 = Element.GetParameterValueByName(element=filterByBoolMask_7.in, parameterName=code_block_29)
convert_between_units_6 = DynamoConvert(getParameterValueByName_9, MeasurementType="Length", FromConversion="Millimeters", ToConversion="Meters")
sum_6 = Math.Sum(values=convert_between_units_6)
formula_6 = Formula("l*4.11", l=sum_6)
code_block_30 = CodeBlock { 65; }
eq_8 = getParameterValueByName_3 == code_block_30
filterByBoolMask_8 = List.FilterByBoolMask(list=filterByBoolMask.in, mask=eq_8)
code_block_31 = CodeBlock { "Length"; }
getParameterValueByName_10 = Element.GetParameterValueByName(element=filterByBoolMask_8.in, parameterName=code_block_31)
convert_between_units_7 = DynamoConvert(getParameterValueByName_10, MeasurementType="Length", FromConversion="Millimeters", ToConversion="Meters")
sum_7 = Math.Sum(values=convert_between_units_7)
formula_7 = Formula("l*5.24", l=sum_7)
code_block_32 = CodeBlock { 80; }
eq_9 = getParameterValueByName_3 == code_block_32
filterByBoolMask_9 = List.FilterByBoolMask(list=filterByBoolMask.in, mask=eq_9)
code_block_33 = CodeBlock { "Length"; }
getParameterValueByName_11 = Element.GetParameterValueByName(element=filterByBoolMask_9.in, parameterName=code_block_33)
convert_between_units_8 = DynamoConvert(getParameterValueByName_11, MeasurementType="Length", FromConversion="Millimeters", ToConversion="Meters")
sum_8 = Math.Sum(values=convert_between_units_8)
formula_8 = Formula("l*6.76", l=sum_8)
code_block_34 = CodeBlock { 100; }
eq_10 = getParameterValueByName_3 == code_block_34
filterByBoolMask_10 = List.FilterByBoolMask(list=filterByBoolMask.in, mask=eq_10)
code_block_35 = CodeBlock { "Length"; }
getParameterValueByName_12 = Element.GetParameterValueByName(element=filterByBoolMask_10.in, parameterName=code_block_35)
convert_between_units_9 = DynamoConvert(getParameterValueByName_12, MeasurementType="Length", FromConversion="Millimeters", ToConversion="Meters")
sum_9 = Math.Sum(values=convert_between_units_9)
formula_9 = Formula("l*9.83", l=sum_9)
code_block_36 = CodeBlock { 125; }
eq_11 = getParameterValueByName_3 == code_block_36
filterByBoolMask_11 = List.FilterByBoolMask(list=filterByBoolMask.in, mask=eq_11)
code_block_37 = CodeBlock { "Length"; }
getParameterValueByName_13 = Element.GetParameterValueByName(element=filterByBoolMask_11.in, parameterName=code_block_37)
convert_between_units_10 = DynamoConvert(getParameterValueByName_13, MeasurementType="Length", FromConversion="Millimeters", ToConversion="Meters")
sum_10 = Math.Sum(values=convert_between_units_10)
formula_10 = Formula("l*13.39", l=sum_10)
code_block_38 = CodeBlock { 150; }
eq_12 = getParameterValueByName_3 == code_block_38
filterByBoolMask_12 = List.FilterByBoolMask(list=filterByBoolMask.in, mask=eq_12)
code_block_39 = CodeBlock { "Length"; }
getParameterValueByName_14 = Element.GetParameterValueByName(element=filterByBoolMask_12.in, parameterName=code_block_39)
convert_between_units_11 = DynamoConvert(getParameterValueByName_14, MeasurementType="Length", FromConversion="Millimeters", ToConversion="Meters")
sum_11 = Math.Sum(values=convert_between_units_11)
formula_11 = Formula("l*18.20", l=sum_11)
code_block_40 = CodeBlock { 200; }
eq_13 = getParameterValueByName_3 == code_block_40
filterByBoolMask_13 = List.FilterByBoolMask(list=filterByBoolMask.in, mask=eq_13)
code_block_41 = CodeBlock { "Length"; }
getParameterValueByName_15 = Element.GetParameterValueByName(element=filterByBoolMask_13.in, parameterName=code_block_41)
convert_between_units_12 = DynamoConvert(getParameterValueByName_15, MeasurementType="Length", FromConversion="Millimeters", ToConversion="Meters")
sum_12 = Math.Sum(values=convert_between_units_12)
formula_12 = Formula("l*33.10", l=sum_12)
code_block_42 = CodeBlock { 250; }
eq_14 = getParameterValueByName_3 == code_block_42
filterByBoolMask_14 = List.FilterByBoolMask(list=filterByBoolMask.in, mask=eq_14)
code_block_43 = CodeBlock { "Length"; }
getParameterValueByName_16 = Element.GetParameterValueByName(element=filterByBoolMask_14.in, parameterName=code_block_43)
convert_between_units_13 = DynamoConvert(getParameterValueByName_16, MeasurementType="Length", FromConversion="Millimeters", ToConversion="Meters")
sum_13 = Math.Sum(values=convert_between_units_13)
formula_13 = Formula("l*41.50", l=sum_13)
code_block_44 = CodeBlock { 300; }
eq_15 = getParameterValueByName_3 == code_block_44
filterByBoolMask_15 = List.FilterByBoolMask(list=filterByBoolMask.in, mask=eq_15)
code_block_45 = CodeBlock { "Length"; }
getParameterValueByName_17 = Element.GetParameterValueByName(element=filterByBoolMask_15.in, parameterName=code_block_45)
convert_between_units_14 = DynamoConvert(getParameterValueByName_17, MeasurementType="Length", FromConversion="Millimeters", ToConversion="Meters")
sum_14 = Math.Sum(values=convert_between_units_14)
formula_14 = Formula("l*55.50", l=sum_14)
code_block_46 = CodeBlock { 350; }
eq_16 = getParameterValueByName_3 == code_block_46
filterByBoolMask_16 = List.FilterByBoolMask(list=filterByBoolMask.in, mask=eq_16)
code_block_47 = CodeBlock { "Length"; }
getParameterValueByName_18 = Element.GetParameterValueByName(element=filterByBoolMask_16.in, parameterName=code_block_47)
convert_between_units_15 = DynamoConvert(getParameterValueByName_18, MeasurementType="Length", FromConversion="Millimeters", ToConversion="Meters")
sum_15 = Math.Sum(values=convert_between_units_15)
formula_15 = Formula("l*68.40", l=sum_15)
formula_16 = Formula("l*0.00023494265", l=sum)
formula_17 = Formula("l*0.00039037265", l=sum_2)
formula_18 = Formula("l*0.00063761625", l=sum_3)
formula_19 = Formula("l*0.0010863144", l=sum_4)
formula_20 = Formula("l*0.00145822385", l=sum_5)
formula_21 = Formula("l*0.00233164625", l=sum_6)
formula_22 = Formula("l*0.00387954065", l=sum_7)
formula_23 = Formula("l*0.00534290625", l=sum_8)
formula_24 = Formula("l*0.00900427185", l=sum_9)
formula_25 = Formula("l*0.01361573865", l=sum_10)
formula_26 = Formula("l*0.01992054465", l=sum_11)
formula_27 = Formula("l*0.03347416625", l=sum_12)
formula_28 = Formula("l*0.0532294056", l=sum_13)
formula_29 = Formula("l*0.07529256065", l=sum_14)
formula_30 = Formula("l*0.0905326056", l=sum_15)

# group: Ukupna Masa
list_create_3 = List.Create(item0=formula, item1=formula_2, item2=formula_3, item3=formula_4, item4=formula_5, item5=formula_6, item6=formula_7, item7=formula_8, item8=formula_9, item9=formula_10, item10=formula_11, item11=formula_12, item12=formula_13, item13=formula_14, item14=formula_15)
sum_16 = Math.Sum(values=list_create_3)

# group: Kolena
code_block_48 = CodeBlock { "CGI-16CA20-FTG-Bend45&90"; }
eq_17 = getParameterValueByName_2 == code_block_48
filterByBoolMask_17 = List.FilterByBoolMask(list=getItemAtIndex, mask=eq_17)
code_block_49 = CodeBlock { "Size"; }
getParameterValueByName_19 = Element.GetParameterValueByName(element=filterByBoolMask_17.in, parameterName=code_block_49)
string_from_object = FromObject(obj=getParameterValueByName_19)
code_block_50 = CodeBlock { 1; }
code_block_51 = CodeBlock { 3; }
substring = String.Substring(str=string_from_object, startIndex=code_block_50, length=code_block_51)
toNumber = String.ToNumber(str=substring)
code_block_52 = CodeBlock { 15; }
eq_18 = toNumber == code_block_52
filterByBoolMask_18 = List.FilterByBoolMask(list=filterByBoolMask_17.in, mask=eq_18)
count = List.Count(list=filterByBoolMask_18.in)
formula_31 = Formula("n*0.04", n=count)
code_block_53 = CodeBlock { 20; }
eq_19 = toNumber == code_block_53
filterByBoolMask_19 = List.FilterByBoolMask(list=filterByBoolMask_17.in, mask=eq_19)
count_2 = List.Count(list=filterByBoolMask_19.in)
formula_32 = Formula("n*0.06", n=count_2)
code_block_54 = CodeBlock { 25; }
eq_20 = toNumber == code_block_54
filterByBoolMask_20 = List.FilterByBoolMask(list=filterByBoolMask_17.in, mask=eq_20)
count_3 = List.Count(list=filterByBoolMask_20.in)
formula_33 = Formula("n*0.12", n=count_3)
code_block_55 = CodeBlock { 32; }
eq_21 = toNumber == code_block_55
filterByBoolMask_21 = List.FilterByBoolMask(list=filterByBoolMask_17.in, mask=eq_21)
count_4 = List.Count(list=filterByBoolMask_21.in)
formula_34 = Formula("n*0.19", n=count_4)
code_block_56 = CodeBlock { 40; }
eq_22 = toNumber == code_block_56
filterByBoolMask_22 = List.FilterByBoolMask(list=filterByBoolMask_17.in, mask=eq_22)
count_5 = List.Count(list=filterByBoolMask_22.in)
formula_35 = Formula("n*0.26", n=count_5)
code_block_57 = CodeBlock { 50; }
eq_23 = toNumber == code_block_57
filterByBoolMask_23 = List.FilterByBoolMask(list=filterByBoolMask_17.in, mask=eq_23)
count_6 = List.Count(list=filterByBoolMask_23.in)
formula_36 = Formula("n*0.49", n=count_6)
code_block_58 = CodeBlock { 65; }
eq_24 = toNumber == code_block_58
filterByBoolMask_24 = List.FilterByBoolMask(list=filterByBoolMask_17.in, mask=eq_24)
count_7 = List.Count(list=filterByBoolMask_24.in)
formula_37 = Formula("n*0.78", n=count_7)
code_block_59 = CodeBlock { 80; }
eq_25 = toNumber == code_block_59
filterByBoolMask_25 = List.FilterByBoolMask(list=filterByBoolMask_17.in, mask=eq_25)
count_8 = List.Count(list=filterByBoolMask_25.in)
formula_38 = Formula("n*1.21", n=count_8)
code_block_60 = CodeBlock { 100; }
eq_26 = toNumber == code_block_60
filterByBoolMask_26 = List.FilterByBoolMask(list=filterByBoolMask_17.in, mask=eq_26)
count_9 = List.Count(list=filterByBoolMask_26.in)
formula_39 = Formula("n*2.35", n=count_9)
code_block_61 = CodeBlock { 125; }
eq_27 = toNumber == code_block_61
filterByBoolMask_27 = List.FilterByBoolMask(list=filterByBoolMask_17.in, mask=eq_27)
count_10 = List.Count(list=filterByBoolMask_27.in)
formula_40 = Formula("n*4", n=count_10)
code_block_62 = CodeBlock { 150; }
eq_28 = toNumber == code_block_62
filterByBoolMask_28 = List.FilterByBoolMask(list=filterByBoolMask_17.in, mask=eq_28)
count_11 = List.Count(list=filterByBoolMask_28.in)
formula_41 = Formula("n*6.54", n=count_11)
code_block_63 = CodeBlock { 200; }
eq_29 = toNumber == code_block_63
filterByBoolMask_29 = List.FilterByBoolMask(list=filterByBoolMask_17.in, mask=eq_29)
count_12 = List.Count(list=filterByBoolMask_29.in)
formula_42 = Formula("n*15.80", n=count_12)
code_block_64 = CodeBlock { 250; }
eq_30 = toNumber == code_block_64
filterByBoolMask_30 = List.FilterByBoolMask(list=filterByBoolMask_17.in, mask=eq_30)
count_13 = List.Count(list=filterByBoolMask_30.in)
formula_43 = Formula("n*24.80", n=count_13)
code_block_65 = CodeBlock { 300; }
eq_31 = toNumber == code_block_65
filterByBoolMask_31 = List.FilterByBoolMask(list=filterByBoolMask_17.in, mask=eq_31)
count_14 = List.Count(list=filterByBoolMask_31.in)
formula_44 = Formula("n*38.90", n=count_14)
code_block_66 = CodeBlock { 350; }
eq_32 = toNumber == code_block_66
filterByBoolMask_32 = List.FilterByBoolMask(list=filterByBoolMask_17.in, mask=eq_32)
count_15 = List.Count(list=filterByBoolMask_32.in)
formula_45 = Formula("n*39.80", n=count_15)
formula_46 = Formula("n*0.00001033", n=count)
formula_47 = Formula("n*0.00001777", n=count_2)
formula_48 = Formula("n*0.00003804", n=count_3)
formula_49 = Formula("n*0.00008186", n=count_4)
formula_50 = Formula("n*0.00013050", n=count_5)
formula_51 = Formula("n*0.00027821", n=count_6)
formula_52 = Formula("n*0.00057863", n=count_7)
formula_53 = Formula("n*0.00095627", n=count_8)
formula_54 = Formula("n*0.00214878", n=count_9)
formula_55 = Formula("n*0.00406157", n=count_10)
formula_56 = Formula("n*0.00716203", n=count_11)
formula_57 = Formula("n*0.01602910", n=count_12)
formula_58 = Formula("n*0.03184023", n=count_13)
formula_59 = Formula("n*0.05402166", n=count_14)
formula_60 = Formula("n*0.07575859", n=count_15)

# group: Ukupna masa
list_create_4 = List.Create(item0=formula_31, item1=formula_32, item2=formula_33, item3=formula_34, item4=formula_35, item5=formula_36, item6=formula_37, item7=formula_38, item8=formula_39, item9=formula_40, item10=formula_41, item11=formula_42, item12=formula_43, item13=formula_44, item14=formula_45)
sum_17 = Math.Sum(values=list_create_4)

# group: T-komad
code_block_67 = CodeBlock { "CGI-16CA20-FTG-Branch-T-Piece"; }
eq_33 = getParameterValueByName_2 == code_block_67
filterByBoolMask_33 = List.FilterByBoolMask(list=getItemAtIndex, mask=eq_33)
code_block_68 = CodeBlock { "Size"; }
getParameterValueByName_20 = Element.GetParameterValueByName(element=filterByBoolMask_33.in, parameterName=code_block_68)
string_from_object_2 = FromObject(obj=getParameterValueByName_20)
code_block_69 = CodeBlock { 1; }
code_block_70 = CodeBlock { 3; }
substring_2 = String.Substring(str=string_from_object_2, startIndex=code_block_69, length=code_block_70)
toNumber_2 = String.ToNumber(str=substring_2)
code_block_71 = CodeBlock { 15; }
eq_34 = toNumber_2 == code_block_71
filterByBoolMask_34 = List.FilterByBoolMask(list=filterByBoolMask_33.in, mask=eq_34)
count_16 = List.Count(list=filterByBoolMask_34.in)
formula_61 = Formula("n*0.09", n=count_16)
code_block_72 = CodeBlock { 20; }
eq_35 = toNumber_2 == code_block_72
filterByBoolMask_35 = List.FilterByBoolMask(list=filterByBoolMask_33.in, mask=eq_35)
count_17 = List.Count(list=filterByBoolMask_35.in)
formula_62 = Formula("n*0.18", n=count_17)
code_block_73 = CodeBlock { 25; }
eq_36 = toNumber_2 == code_block_73
filterByBoolMask_36 = List.FilterByBoolMask(list=filterByBoolMask_33.in, mask=eq_36)
count_18 = List.Count(list=filterByBoolMask_36.in)
formula_63 = Formula("n*0.35", n=count_18)
code_block_74 = CodeBlock { 32; }
eq_37 = toNumber_2 == code_block_74
filterByBoolMask_37 = List.FilterByBoolMask(list=filterByBoolMask_33.in, mask=eq_37)
count_19 = List.Count(list=filterByBoolMask_37.in)
formula_64 = Formula("n*0.59", n=count_19)
code_block_75 = CodeBlock { 40; }
eq_38 = toNumber_2 == code_block_75
filterByBoolMask_38 = List.FilterByBoolMask(list=filterByBoolMask_33.in, mask=eq_38)
count_20 = List.Count(list=filterByBoolMask_38.in)
formula_65 = Formula("n*0.83", n=count_20)
code_block_76 = CodeBlock { 50; }
eq_39 = toNumber_2 == code_block_76
filterByBoolMask_39 = List.FilterByBoolMask(list=filterByBoolMask_33.in, mask=eq_39)
count_21 = List.Count(list=filterByBoolMask_39.in)
formula_66 = Formula("n*1.33", n=count_21)
code_block_77 = CodeBlock { 65; }
eq_40 = toNumber_2 == code_block_77
filterByBoolMask_40 = List.FilterByBoolMask(list=filterByBoolMask_33.in, mask=eq_40)
count_22 = List.Count(list=filterByBoolMask_40.in)
formula_67 = Formula("n*2.08", n=count_22)
code_block_78 = CodeBlock { 80; }
eq_41 = toNumber_2 == code_block_78
filterByBoolMask_41 = List.FilterByBoolMask(list=filterByBoolMask_33.in, mask=eq_41)
count_23 = List.Count(list=filterByBoolMask_41.in)
formula_68 = Formula("n*3.07", n=count_23)
code_block_79 = CodeBlock { 100; }
eq_42 = toNumber_2 == code_block_79
filterByBoolMask_42 = List.FilterByBoolMask(list=filterByBoolMask_33.in, mask=eq_42)
count_24 = List.Count(list=filterByBoolMask_42.in)
formula_69 = Formula("n*5.58", n=count_24)
code_block_80 = CodeBlock { 125; }
eq_43 = toNumber_2 == code_block_80
filterByBoolMask_43 = List.FilterByBoolMask(list=filterByBoolMask_33.in, mask=eq_43)
count_25 = List.Count(list=filterByBoolMask_43.in)
formula_70 = Formula("n*9.08", n=count_25)
code_block_81 = CodeBlock { 150; }
eq_44 = toNumber_2 == code_block_81
filterByBoolMask_44 = List.FilterByBoolMask(list=filterByBoolMask_33.in, mask=eq_44)
count_26 = List.Count(list=filterByBoolMask_44.in)
formula_71 = Formula("n*14.38", n=count_26)
code_block_82 = CodeBlock { 200; }
eq_45 = toNumber_2 == code_block_82
filterByBoolMask_45 = List.FilterByBoolMask(list=filterByBoolMask_33.in, mask=eq_45)
count_27 = List.Count(list=filterByBoolMask_45.in)
formula_72 = Formula("n*32.53", n=count_27)
code_block_83 = CodeBlock { 250; }
eq_46 = toNumber_2 == code_block_83
filterByBoolMask_46 = List.FilterByBoolMask(list=filterByBoolMask_33.in, mask=eq_46)
count_28 = List.Count(list=filterByBoolMask_46.in)
formula_73 = Formula("n*50.56", n=count_28)
code_block_84 = CodeBlock { 300; }
eq_47 = toNumber_2 == code_block_84
filterByBoolMask_47 = List.FilterByBoolMask(list=filterByBoolMask_33.in, mask=eq_47)
count_29 = List.Count(list=filterByBoolMask_47.in)
formula_74 = Formula("n*80.54", n=count_29)
code_block_85 = CodeBlock { 350; }
eq_48 = toNumber_2 == code_block_85
filterByBoolMask_48 = List.FilterByBoolMask(list=filterByBoolMask_33.in, mask=eq_48)
count_30 = List.Count(list=filterByBoolMask_48.in)
formula_75 = Formula("n*109.58", n=count_30)
formula_76 = Formula("n*0.0000156", n=count_16)
formula_77 = Formula("n*0.0000296", n=count_17)
formula_78 = Formula("n*0.0000636", n=count_18)
formula_79 = Formula("n*0.0001362", n=count_19)
formula_80 = Formula("n*0.0002179", n=count_20)
formula_81 = Formula("n*0.0003841", n=count_21)
formula_82 = Formula("n*0.0007482", n=count_22)
formula_83 = Formula("n*0.0011581", n=count_23)
formula_84 = Formula("n*0.0023542", n=count_24)
formula_85 = Formula("n*0.0041685", n=count_25)
formula_86 = Formula("n*0.0069592", n=count_26)
formula_87 = Formula("n*0.014419", n=count_27)
formula_88 = Formula("n*0.0275622", n=count_28)
formula_89 = Formula("n*0.0457139", n=count_29)
formula_90 = Formula("n*0.0604034", n=count_30)

# group: Ukupna masa
list_create_5 = List.Create(item0=formula_61, item1=formula_62, item2=formula_63, item3=formula_64, item4=formula_65, item5=formula_66, item6=formula_67, item7=formula_68, item8=formula_69, item9=formula_70, item10=formula_71, item11=formula_72, item12=formula_73, item13=formula_74, item14=formula_75)
sum_18 = Math.Sum(values=list_create_5)

# group: Redukcija
code_block_86 = CodeBlock { "CGI-16CA20-FTG-Reduction"; }
eq_49 = getParameterValueByName_2 == code_block_86
filterByBoolMask_49 = List.FilterByBoolMask(list=getItemAtIndex, mask=eq_49)
code_block_87 = CodeBlock { "Size"; }
getParameterValueByName_21 = Element.GetParameterValueByName(element=filterByBoolMask_49.in, parameterName=code_block_87)
string_from_object_3 = FromObject(obj=getParameterValueByName_21)
code_block_88 = CodeBlock { 1; }
code_block_89 = CodeBlock { 3; }
substring_3 = String.Substring(str=string_from_object_3, startIndex=code_block_88, length=code_block_89)
toNumber_3 = String.ToNumber(str=substring_3)
code_block_90 = CodeBlock { 20; }
eq_50 = toNumber_3 == code_block_90
filterByBoolMask_50 = List.FilterByBoolMask(list=filterByBoolMask_49.in, mask=eq_50)
count_31 = List.Count(list=filterByBoolMask_50.in)
formula_91 = Formula("n*0.04", n=count_31)
code_block_91 = CodeBlock { 25; }
eq_51 = toNumber_3 == code_block_91
filterByBoolMask_51 = List.FilterByBoolMask(list=filterByBoolMask_49.in, mask=eq_51)
count_32 = List.Count(list=filterByBoolMask_51.in)
formula_92 = Formula("n*0.10", n=count_32)
code_block_92 = CodeBlock { 32; }
eq_52 = toNumber_3 == code_block_92
filterByBoolMask_52 = List.FilterByBoolMask(list=filterByBoolMask_49.in, mask=eq_52)
count_33 = List.Count(list=filterByBoolMask_52.in)
formula_93 = Formula("n*0.13", n=count_33)
code_block_93 = CodeBlock { 40; }
eq_53 = toNumber_3 == code_block_93
filterByBoolMask_53 = List.FilterByBoolMask(list=filterByBoolMask_49.in, mask=eq_53)
count_34 = List.Count(list=filterByBoolMask_53.in)
formula_94 = Formula("n*0.19", n=count_34)
code_block_94 = CodeBlock { 50; }
eq_54 = toNumber_3 == code_block_94
filterByBoolMask_54 = List.FilterByBoolMask(list=filterByBoolMask_49.in, mask=eq_54)
count_35 = List.Count(list=filterByBoolMask_54.in)
formula_95 = Formula("n*0.31", n=count_35)
code_block_95 = CodeBlock { 65; }
eq_55 = toNumber_3 == code_block_95
filterByBoolMask_55 = List.FilterByBoolMask(list=filterByBoolMask_49.in, mask=eq_55)
count_36 = List.Count(list=filterByBoolMask_55.in)
formula_96 = Formula("n*0.48", n=count_36)
code_block_96 = CodeBlock { 80; }
eq_56 = toNumber_3 == code_block_96
filterByBoolMask_56 = List.FilterByBoolMask(list=filterByBoolMask_49.in, mask=eq_56)
count_37 = List.Count(list=filterByBoolMask_56.in)
formula_97 = Formula("n*0.68", n=count_37)
code_block_97 = CodeBlock { 100; }
eq_57 = toNumber_3 == code_block_97
filterByBoolMask_57 = List.FilterByBoolMask(list=filterByBoolMask_49.in, mask=eq_57)
count_38 = List.Count(list=filterByBoolMask_57.in)
formula_98 = Formula("n*0.99", n=count_38)
code_block_98 = CodeBlock { 125; }
eq_58 = toNumber_3 == code_block_98
filterByBoolMask_58 = List.FilterByBoolMask(list=filterByBoolMask_49.in, mask=eq_58)
count_39 = List.Count(list=filterByBoolMask_58.in)
formula_99 = Formula("n*1.71", n=count_39)
code_block_99 = CodeBlock { 150; }
eq_59 = toNumber_3 == code_block_99
filterByBoolMask_59 = List.FilterByBoolMask(list=filterByBoolMask_49.in, mask=eq_59)
count_40 = List.Count(list=filterByBoolMask_59.in)
formula_100 = Formula("n*2.53", n=count_40)
code_block_100 = CodeBlock { 200; }
eq_60 = toNumber_3 == code_block_100
filterByBoolMask_60 = List.FilterByBoolMask(list=filterByBoolMask_49.in, mask=eq_60)
count_41 = List.Count(list=filterByBoolMask_60.in)
formula_101 = Formula("n*4.71", n=count_41)
code_block_101 = CodeBlock { 250; }
eq_61 = toNumber_3 == code_block_101
filterByBoolMask_61 = List.FilterByBoolMask(list=filterByBoolMask_49.in, mask=eq_61)
count_42 = List.Count(list=filterByBoolMask_61.in)
formula_102 = Formula("n*7.40", n=count_42)
code_block_102 = CodeBlock { 300; }
eq_62 = toNumber_3 == code_block_102
filterByBoolMask_62 = List.FilterByBoolMask(list=filterByBoolMask_49.in, mask=eq_62)
count_43 = List.Count(list=filterByBoolMask_62.in)
formula_103 = Formula("n*11.30", n=count_43)
code_block_103 = CodeBlock { 350; }
eq_63 = toNumber_3 == code_block_103
filterByBoolMask_63 = List.FilterByBoolMask(list=filterByBoolMask_49.in, mask=eq_63)
count_44 = List.Count(list=filterByBoolMask_63.in)
formula_104 = Formula("n*22.50", n=count_44)
formula_105 = Formula("n*0.0000119", n=count_31)
formula_106 = Formula("n*0.0000257", n=count_32)
formula_107 = Formula("n*0.0000431", n=count_33)
formula_108 = Formula("n*0.0000814", n=count_34)
formula_109 = Formula("n*0.000144", n=count_35)
formula_110 = Formula("n*0.0002795", n=count_36)
formula_111 = Formula("n*0.000415", n=count_37)
formula_112 = Formula("n*0.0007174", n=count_38)
formula_113 = Formula("n*0.0014364", n=count_39)
formula_114 = Formula("n*0.0023475", n=count_40)
formula_115 = Formula("n*0.004058", n=count_41)
formula_116 = Formula("n*0.0077166", n=count_42)
formula_117 = Formula("n*0.013045", n=count_43)
formula_118 = Formula("n*0.0273612", n=count_44)

# group: Ukupna masa
list_create_6 = List.Create(item0=formula_91, item1=formula_92, item2=formula_93, item3=formula_94, item4=formula_95, item5=formula_96, item6=formula_97, item7=formula_98, item8=formula_99, item9=formula_100, item10=formula_101, item11=formula_102, item12=formula_103, item13=formula_104)
sum_19 = Math.Sum(values=list_create_6)

# group: Cep
code_block_104 = CodeBlock { "CGI-16CA20-FTG-EndCap"; }
eq_64 = getParameterValueByName_2 == code_block_104
filterByBoolMask_64 = List.FilterByBoolMask(list=getItemAtIndex, mask=eq_64)
code_block_105 = CodeBlock { "Size"; }
getParameterValueByName_22 = Element.GetParameterValueByName(element=filterByBoolMask_64.in, parameterName=code_block_105)
string_from_object_4 = FromObject(obj=getParameterValueByName_22)
code_block_106 = CodeBlock { 1; }
code_block_107 = CodeBlock { 3; }
substring_4 = String.Substring(str=string_from_object_4, startIndex=code_block_106, length=code_block_107)
toNumber_4 = String.ToNumber(str=substring_4)
code_block_108 = CodeBlock { 15; }
eq_65 = toNumber_4 == code_block_108
filterByBoolMask_65 = List.FilterByBoolMask(list=filterByBoolMask_64.in, mask=eq_65)
count_45 = List.Count(list=filterByBoolMask_65.in)
formula_119 = Formula("n*0.03", n=count_45)
code_block_109 = CodeBlock { 20; }
eq_66 = toNumber_4 == code_block_109
filterByBoolMask_66 = List.FilterByBoolMask(list=filterByBoolMask_64.in, mask=eq_66)
count_46 = List.Count(list=filterByBoolMask_66.in)
formula_120 = Formula("n*0.04", n=count_46)
code_block_110 = CodeBlock { 25; }
eq_67 = toNumber_4 == code_block_110
filterByBoolMask_67 = List.FilterByBoolMask(list=filterByBoolMask_64.in, mask=eq_67)
count_47 = List.Count(list=filterByBoolMask_67.in)
formula_121 = Formula("n*0.05", n=count_47)
code_block_111 = CodeBlock { 32; }
eq_68 = toNumber_4 == code_block_111
filterByBoolMask_68 = List.FilterByBoolMask(list=filterByBoolMask_64.in, mask=eq_68)
count_48 = List.Count(list=filterByBoolMask_68.in)
formula_122 = Formula("n*0.07", n=count_48)
code_block_112 = CodeBlock { 40; }
eq_69 = toNumber_4 == code_block_112
filterByBoolMask_69 = List.FilterByBoolMask(list=filterByBoolMask_64.in, mask=eq_69)
count_49 = List.Count(list=filterByBoolMask_69.in)
formula_123 = Formula("n*0.10", n=count_49)
code_block_113 = CodeBlock { 50; }
eq_70 = toNumber_4 == code_block_113
filterByBoolMask_70 = List.FilterByBoolMask(list=filterByBoolMask_64.in, mask=eq_70)
count_50 = List.Count(list=filterByBoolMask_70.in)
formula_124 = Formula("n*0.13", n=count_50)
code_block_114 = CodeBlock { 65; }
eq_71 = toNumber_4 == code_block_114
filterByBoolMask_71 = List.FilterByBoolMask(list=filterByBoolMask_64.in, mask=eq_71)
count_51 = List.Count(list=filterByBoolMask_71.in)
formula_125 = Formula("n*0.20", n=count_51)
code_block_115 = CodeBlock { 80; }
eq_72 = toNumber_4 == code_block_115
filterByBoolMask_72 = List.FilterByBoolMask(list=filterByBoolMask_64.in, mask=eq_72)
count_52 = List.Count(list=filterByBoolMask_72.in)
formula_126 = Formula("n*0.43", n=count_52)
code_block_116 = CodeBlock { 100; }
eq_73 = toNumber_4 == code_block_116
filterByBoolMask_73 = List.FilterByBoolMask(list=filterByBoolMask_64.in, mask=eq_73)
count_53 = List.Count(list=filterByBoolMask_73.in)
formula_127 = Formula("n*0.66", n=count_53)
code_block_117 = CodeBlock { 125; }
eq_74 = toNumber_4 == code_block_117
filterByBoolMask_74 = List.FilterByBoolMask(list=filterByBoolMask_64.in, mask=eq_74)
count_54 = List.Count(list=filterByBoolMask_74.in)
formula_128 = Formula("n*0.96", n=count_54)
code_block_118 = CodeBlock { 150; }
eq_75 = toNumber_4 == code_block_118
filterByBoolMask_75 = List.FilterByBoolMask(list=filterByBoolMask_64.in, mask=eq_75)
count_55 = List.Count(list=filterByBoolMask_75.in)
formula_129 = Formula("n*1.70", n=count_55)
code_block_119 = CodeBlock { 200; }
eq_76 = toNumber_4 == code_block_119
filterByBoolMask_76 = List.FilterByBoolMask(list=filterByBoolMask_64.in, mask=eq_76)
count_56 = List.Count(list=filterByBoolMask_76.in)
formula_130 = Formula("n*3.30", n=count_56)
code_block_120 = CodeBlock { 250; }
eq_77 = toNumber_4 == code_block_120
filterByBoolMask_77 = List.FilterByBoolMask(list=filterByBoolMask_64.in, mask=eq_77)
count_57 = List.Count(list=filterByBoolMask_77.in)
formula_131 = Formula("n*5.60", n=count_57)
code_block_121 = CodeBlock { 300; }
eq_78 = toNumber_4 == code_block_121
filterByBoolMask_78 = List.FilterByBoolMask(list=filterByBoolMask_64.in, mask=eq_78)
count_58 = List.Count(list=filterByBoolMask_78.in)
formula_132 = Formula("n*9", n=count_58)
code_block_122 = CodeBlock { 350; }
eq_79 = toNumber_4 == code_block_122
filterByBoolMask_79 = List.FilterByBoolMask(list=filterByBoolMask_64.in, mask=eq_79)
count_59 = List.Count(list=filterByBoolMask_79.in)
formula_133 = Formula("n*13.20", n=count_59)
formula_134 = Formula("n*0.0000059", n=count_45)
formula_135 = Formula("n*0.0000098", n=count_46)
formula_136 = Formula("n*0.0000242", n=count_47)
formula_137 = Formula("n*0.0000413", n=count_48)
formula_138 = Formula("n*0.0000554", n=count_49)
formula_139 = Formula("n*0.0000886", n=count_50)
formula_140 = Formula("n*0.0001474", n=count_51)
formula_141 = Formula("n*0.0002725", n=count_52)
formula_142 = Formula("n*0.0005763", n=count_53)
formula_143 = Formula("n*0.0010348", n=count_54)
formula_144 = Formula("n*0.0017729", n=count_55)
formula_145 = Formula("n*0.0034144", n=count_56)
formula_146 = Formula("n*0.0067601", n=count_57)
formula_147 = Formula("n*0.0114445", n=count_58)
formula_148 = Formula("n*0.0149379", n=count_59)

# group: Ukupna masa
list_create_7 = List.Create(item0=formula_119, item1=formula_120, item2=formula_121, item3=formula_122, item4=formula_123, item5=formula_124, item6=formula_125, item7=formula_126, item8=formula_127, item9=formula_128, item10=formula_129, item11=formula_130, item12=formula_131, item13=formula_132, item14=formula_133)
sum_20 = Math.Sum(values=list_create_7)

# group: Ukupna masa cevi i fitinga
list_create_8 = List.Create(item0=sum_16, item1=sum_17, item2=sum_18, item3=sum_19, item4=sum_20)
sum_21 = Math.Sum(values=list_create_8)

# group: Uslov za medijum
code_block_123 = CodeBlock { 0; }
getItemAtIndex_2 = List.GetItemAtIndex(list=multipleinputform.User_Inputs, index=code_block_123)
code_block_124 = CodeBlock { "/"; }
eq_80 = getItemAtIndex_2 == code_block_124
code_block_125 = CodeBlock { 0; }
code_block_126 = CodeBlock { Greska; }  # unwired: Greska
if_ = If(test=eq_80, true=code_block_125, false=code_block_126)
code_block_127 = CodeBlock { "Voda"; }
eq_81 = getItemAtIndex_2 == code_block_127
code_block_128 = CodeBlock { 1000; }
code_block_129 = CodeBlock { Greska; }  # unwired: Greska
if_2 = If(test=eq_81, true=code_block_128, false=code_block_129)
code_block_130 = CodeBlock { "Etilen Glikol 30%"; }
eq_82 = getItemAtIndex_2 == code_block_130
code_block_131 = CodeBlock { 1046.7; }
code_block_132 = CodeBlock { Greska; }  # unwired: Greska
if_3 = If(test=eq_82, true=code_block_131, false=code_block_132)
list_create_9 = List.Create(item0=if_, item1=if_2, item2=if_3)

# group: Gustina tecnosti
clear_list = Custom[Clear List](input=list_create_9)  # package archi-lab.net; This node will remove all Null and Empty Lists from any list.

# group: Ukupna zapremina
list_create_10 = List.Create(item0=formula_16, item1=formula_17, item2=formula_18, item3=formula_19, item4=formula_20, item5=formula_21, item6=formula_22, item7=formula_23, item8=formula_24, item9=formula_25, item10=formula_26, item11=formula_27, item12=formula_28, item13=formula_29, item14=formula_30)
sum_22 = Math.Sum(values=list_create_10)

# group: Ukupna zapremina
list_create_11 = List.Create(item0=formula_46, item1=formula_47, item2=formula_48, item3=formula_49, item4=formula_50, item5=formula_51, item6=formula_52, item7=formula_53, item8=formula_54, item9=formula_55, item10=formula_56, item11=formula_57, item12=formula_58, item13=formula_59, item14=formula_60)
sum_23 = Math.Sum(values=list_create_11)

# group: Ukupna zapremina
list_create_12 = List.Create(item0=formula_76, item1=formula_77, item2=formula_78, item3=formula_79, item4=formula_80, item5=formula_81, item6=formula_82, item7=formula_83, item8=formula_84, item9=formula_85, item10=formula_86, item11=formula_87, item12=formula_88, item13=formula_89, item14=formula_90)
sum_24 = Math.Sum(values=list_create_12)

# group: Ukupna zapremina
list_create_13 = List.Create(item0=formula_105, item1=formula_106, item2=formula_107, item3=formula_108, item4=formula_109, item5=formula_110, item6=formula_111, item7=formula_112, item8=formula_113, item9=formula_114, item10=formula_115, item11=formula_116, item12=formula_117, item13=formula_118)
sum_25 = Math.Sum(values=list_create_13)

# group: Ukupna zapremina
list_create_14 = List.Create(item0=formula_134, item1=formula_135, item2=formula_136, item3=formula_137, item4=formula_138, item5=formula_139, item6=formula_140, item7=formula_141, item8=formula_142, item9=formula_143, item10=formula_144, item11=formula_145, item12=formula_146, item13=formula_147, item14=formula_148)
sum_26 = Math.Sum(values=list_create_14)

# group: Ukupna zapremina cevi i fitinga
list_create_15 = List.Create(item0=sum_22, item1=sum_23, item2=sum_24, item3=sum_25, item4=sum_26)
sum_27 = Math.Sum(values=list_create_15)

formula_149 = Formula("m+r*V", m=sum_21, r=clear_list, v=sum_27)
number = DoubleInput(2)
number_to_rounded_string = Custom[Number to Rounded String](Number=formula_149, Decimals=number)  # package Data-Shapes; Returns rounded number to specified number of decimals as string
textnote_data = Custom[TextNote Data](Title=code_block_3, TextNote=number_to_rounded_string)  # package Data-Shapes; Create Data for TextNote input in UI.MultipleInputForm ++ . Check out www.data-shapes.net for more informations
code_block_133 = CodeBlock { "Ukupna potrebna zapremina [m3]:"; }
number_2 = DoubleInput(3)
number_to_rounded_string_2 = Custom[Number to Rounded String](Number=sum_27, Decimals=number_2)
textnote_data_2 = Custom[TextNote Data](Title=code_block_133, TextNote=number_to_rounded_string_2)
list_create_16 = List.Create(item0=textnote_data, item1=textnote_data_2)
inputgroup_data = Custom[InputGroup Data](Inputs=list_create_16)  # package Data-Shapes; Creates a group of inputs for UI.MultipleInputForm ++ . Check out www.data-shapes.net for more infos !
boolean_3 = BoolSelector(true)
multipleinputform_2 = Custom[MultipleInputForm ++](Description_optional=code_block, Logo_optional=file_path, ButtonText_optional=code_block_2, Inputs=inputgroup_data, Toggle=boolean_3)
