# Dynamo graph script.dyn "Pipe Length" (Dynamo 2.6.1.8786)
# packages: Data-Shapes 2022.2.99

file_path = Filename("\\Svch01102\rsb$\PRO\000_Administration\022_Razmena\03_Office Template (Revit)\Extension\chemgineering_logo-1-700x350.png")
code_block = CodeBlock { "Gotovo"; }
code_block_2 = CodeBlock { "Ukupna duzina cevi iznosi [m]:"; }
code_block_3 = CodeBlock { "Izracunavanje duzine cevi"; }
file_path_2 = Filename("\\Svch01102\rsb$\PRO\000_Administration\022_Razmena\03_Office Template (Revit)\Extension\chemgineering_logo-1-700x350.png")
code_block_4 = CodeBlock { "Pokreni"; }
code_block_5 = CodeBlock { "Selektuj cevi"; }
code_block_6 = CodeBlock { "Selektuj"; }
selectmodelelements_data = Custom[SelectModelElements Data](InputName=code_block_5, ButtonText=code_block_6)  # package Data-Shapes; Creates a Revit element selection input for UI.MultipleInputForm++ . Check out www.data-shapes.net for more infos!
boolean = BoolSelector(true)
code_block_7 = CodeBlock { "Ponisti"; }
multipleinputform = Custom[MultipleInputForm ++](Description_optional=code_block_3, Logo_optional=file_path_2, ButtonText_optional=code_block_4, Inputs=selectmodelelements_data, Toggle=boolean, CancelButtonText_optional=code_block_7)  # package Data-Shapes; Create a form with multiple inputs. see www.data-shapes.net for tutorials and infos!
code_block_8 = CodeBlock { "Family"; }
getParameterValueByName = Element.GetParameterValueByName(element=multipleinputform.User_Inputs, parameterName=code_block_8)
code_block_9 = CodeBlock { "Family Name"; }
getParameterValueByName_2 = Element.GetParameterValueByName(element=getParameterValueByName, parameterName=code_block_9)
code_block_10 = CodeBlock { "Pipe Types"; }
eq = getParameterValueByName_2 == code_block_10
filterByBoolMask = List.FilterByBoolMask(list=multipleinputform.User_Inputs, mask=eq)

# group: Cevi
code_block_11 = CodeBlock { "Length"; }
getParameterValueByName_3 = Element.GetParameterValueByName(element=filterByBoolMask.in, parameterName=code_block_11)
sum = Math.Sum(values=getParameterValueByName_3)

convert_between_units = DynamoConvert(sum, MeasurementType="Length", FromConversion="Millimeters", ToConversion="Meters")
number_to_rounded_string = Custom[Number to Rounded String](Number=convert_between_units)  # package Data-Shapes; Returns rounded number to specified number of decimals as string
textnote_data = Custom[TextNote Data](Title=code_block_2, TextNote=number_to_rounded_string)  # package Data-Shapes; Create Data for TextNote input in UI.MultipleInputForm ++ . Check out www.data-shapes.net for more informations
boolean_2 = BoolSelector(true)
number = DoubleInput(250)
multipleinputform_2 = Custom[MultipleInputForm ++](Logo_optional=file_path, ButtonText_optional=code_block, Inputs=textnote_data, Toggle=boolean_2, LabelWidth_optional=number)
