# Dynamo graph script.dyn "Change Elements Level" (Dynamo 2.6.1.8786)
# packages: archi-lab.net 2023.213.1523, Data-Shapes 2022.2.99

categories = Categories("OST_StructuralColumns")
code_block = CodeBlock { "Promena referentnog Level-a Structural Column i Floor"; }
file_path = Filename("\\Svch01102\rsb$\PRO\000_Administration\022_Razmena\03_Office Template (Revit)\Extension\chemgineering_logo-1-700x350.png")
code_block_2 = CodeBlock { "Pokreni"; }
code_block_3 = CodeBlock { "Level koji zelite da obrisete"; }
element_types = ElementTypes("Level")
all_elements_of_type = ElementsOfType(element_type=element_types)
code_block_4 = CodeBlock { "Name"; }
getParameterValueByName = Element.GetParameterValueByName(element=all_elements_of_type, parameterName=code_block_4)
dropdown_data = Custom[DropDown Data](InputName=code_block_3, Keys=getParameterValueByName, Values=all_elements_of_type)  # package Data-Shapes; Create data for DropDown input in UI.MultiInputForm ++ . Check out www.data-shapes.net for more infos.
code_block_5 = CodeBlock { "Novi referentni Level"; }
element_types_2 = ElementTypes("Level")
all_elements_of_type_2 = ElementsOfType(element_type=element_types_2)
code_block_6 = CodeBlock { "Name"; }
getParameterValueByName_2 = Element.GetParameterValueByName(element=all_elements_of_type_2, parameterName=code_block_6)
dropdown_data_2 = Custom[DropDown Data](InputName=code_block_5, Keys=getParameterValueByName_2, Values=all_elements_of_type_2)
list_create = List.Create(item0=dropdown_data, item1=dropdown_data_2)
boolean = BoolSelector(true)
code_block_7 = CodeBlock { "Ponisti"; }
code_block_8 = CodeBlock { 200; }
multipleinputform = Custom[MultipleInputForm ++](Description_optional=code_block, Logo_optional=file_path, ButtonText_optional=code_block_2, Inputs=list_create, Toggle=boolean, CancelButtonText_optional=code_block_7, LabelWidth_optional=code_block_8)  # package Data-Shapes; Create a form with multiple inputs. see www.data-shapes.net for tutorials and infos!
code_block_9 = CodeBlock { 0; }
getItemAtIndex = List.GetItemAtIndex(list=multipleinputform.User_Inputs, index=code_block_9)
byCategoryAndLevel = archilab.Revit.Selection.Select.ByCategoryAndLevel(category=categories, level=getItemAtIndex)
code_block_10 = CodeBlock { "Base Level"; }
code_block_11 = CodeBlock { 1; }
getItemAtIndex_2 = List.GetItemAtIndex(list=multipleinputform.User_Inputs, index=code_block_11)
setParameterByName = Element.SetParameterByName(element=byCategoryAndLevel, parameterName=code_block_10, value=getItemAtIndex_2)
code_block_12 = CodeBlock { "Base Offset"; }
code_block_13 = CodeBlock { "Elevation"; }
getParameterValueByName_3 = Element.GetParameterValueByName(element=getItemAtIndex, parameterName=code_block_13)
code_block_14 = CodeBlock { "Elevation"; }
getParameterValueByName_4 = Element.GetParameterValueByName(element=getItemAtIndex_2, parameterName=code_block_14)
getParameterValueByName_5 = Element.GetParameterValueByName(element=byCategoryAndLevel, parameterName=code_block_12)
formula = Formula("bl-ll+boff", bl=getParameterValueByName_3, ll=getParameterValueByName_4, boff=getParameterValueByName_5)
setParameterByName_2 = Element.SetParameterByName(element=byCategoryAndLevel, parameterName=code_block_12, value=formula)
categories_2 = Categories("OST_Floors")
byCategoryAndLevel_2 = archilab.Revit.Selection.Select.ByCategoryAndLevel(category=categories_2, level=getItemAtIndex)
code_block_15 = CodeBlock { "Level"; }
setParameterByName_3 = Element.SetParameterByName(element=byCategoryAndLevel_2, parameterName=code_block_15, value=getItemAtIndex_2)
code_block_16 = CodeBlock { "Height Offset From Level"; }
code_block_17 = CodeBlock { "Height Offset From Level"; }
getParameterValueByName_6 = Element.GetParameterValueByName(element=byCategoryAndLevel_2, parameterName=code_block_17)
formula_2 = Formula("e1-e2+h", e1=getParameterValueByName_3, e2=getParameterValueByName_4, h=getParameterValueByName_6)
setParameterByName_4 = Element.SetParameterByName(element=byCategoryAndLevel_2, parameterName=code_block_16, value=formula_2)
